# Grasshopper definition SpookyBlood.gh (Grasshopper 1.0.7)
# plug-ins: Kangaroo2 Components

offset = OffsetSurface(Distance=0, Retrim=True)
hframe = HorizontalFrame()
zombiesolver = ZombieSolver(Threshold=1e-10, Tolerance=0.01, MaxIterations=50000)  # -> I, V, O
offset_2 = OffsetSurface(Distance=0, Retrim=True)

c_script = CSharpScript(
    reset=Button(),
    shoot=Toggle(True),
    color=ColourSwatch(SwatchColor=RGBA(72, 181, 0, 53)),
    speed=Slider(100, range=0..100),
    go=Toggle(False),
    Reference="C:\Users\Benjamin\Work\02-FlexHopper\Code\FlexCLI\bin\Release\FlexCLI.dll")  # -> out, A; inputs reset: Boolean, shoot: Boolean, color: Color, speed: Double, go: Boolean
# ---------- c_script: C# usings ----------
using FlexCLI;
using System.Drawing;
# ---------- c_script: C# ----------
    Go = go;
    Shoot = shoot;
    Speed = speed;
    Col = color;

    if(reset)
    {
      if(flex != null)
      {
        flex.Destroy();
        Grasshopper.Instances.ActiveCanvas.CanvasPostPaintOverlay -= ccc;

      }

      Rhino.RhinoApp.WriteLine("comp: outpgX: " + this.Component.Attributes.OutputGrip.X + " outpgY: " + this.Component.Attributes.OutputGrip.Y +
        " boundX: " + this.Component.Attributes.Bounds.X + " boundY: " + this.Component.Attributes.Bounds.Y);

      flex = new FlexCLI.Flex();
      scene = new FlexScene();
      var pos = new List<float>();
      var vel = new List<float>();
      var im = new List<float>();
      for(int n = 0; n < N; n++)
      {
        pos.Add(this.Component.Attributes.OutputGrip.X + (float) rnd.NextDouble() * 20.0f - 10.0f);
        pos.Add(0.0f);
        pos.Add(this.Component.Attributes.OutputGrip.Y + (float) rnd.NextDouble() * 20.0f - 10.0f);
        vel.Add((float) rnd.NextDouble() * 10.0f + (float) speed);
        vel.Add(0.0f);
        vel.Add((float) rnd.NextDouble() * 4.0f - 2.0f);
        im.Add(1.0f);
      }
      scene.RegisterParticles(
        pos.ToArray(),
        vel.ToArray(),
        im.ToArray(),
        true,
        true,
        0);

      flex.SetScene(scene);

      FlexCLI.FlexParams p = new FlexCLI.FlexParams();
      p.GravityZ = 9.81f;
      p.MaxSpeed = 1000.0f;
      p.Radius = partRadius * 1.5f;
      p.FluidRestDistance = partRadius;
      p.CollisionDistance = partRadius;
      flex.SetParams(p);

      flex.SetCollisionGeometry(CollisionGeometry());

      FlexCLI.FlexSolverOptions opts = new FlexCLI.FlexSolverOptions(0.05f, 3, 3, 1, -1);
      flex.SetSolverOptions(opts);
      i = 0;

      ccc = new Grasshopper.GUI.Canvas.GH_Canvas.CanvasPostPaintOverlayEventHandler(DrawFlex);
      Grasshopper.Instances.ActiveCanvas.CanvasPostPaintOverlay += ccc;
    }
# ---------- c_script: C# additional code ----------
  int N = 15;
  int shootIter = 5;
  Random rnd = new Random();
  FlexCLI.Flex flex = null;
  FlexCLI.FlexScene scene = null;
  int i = 0;
  float partRadius = 4.0f;
  bool Go = false;
  bool Shoot = false;
  double Speed = 10.0;
  Color Col;
  System.Drawing.Pen pen = new System.Drawing.Pen(System.Drawing.Brushes.DarkCyan, 1.0f);

  Grasshopper.GUI.Canvas.GH_Canvas.CanvasPostPaintOverlayEventHandler ccc = null;
  Grasshopper.GUI.Canvas.GH_Viewport viewport = Grasshopper.Instances.ActiveCanvas.Viewport;



  void AddParticles()
  {
    Rhino.RhinoApp.WriteLine("shoot");

    var pos = new List<float>();
    var vel = new List<float>();
    var im = new List<float>();
    for(int n = 0; n < N; n++)
    {
      pos.Add(this.Component.Attributes.OutputGrip.X + (float) rnd.NextDouble() * 20.0f - 10.0f);
      pos.Add(0.0f);
      pos.Add(this.Component.Attributes.OutputGrip.Y + (float) rnd.NextDouble() * 20.0f - 10.0f);
      vel.Add((float) rnd.NextDouble() * 10.0f + (float) Speed);
      vel.Add(0.0f);
      vel.Add((float) rnd.NextDouble() * 4.0f - 2.0f);
      im.Add(1.0f);
    }

    scene.RegisterParticles(pos.ToArray(),
      vel.ToArray(),
      im.ToArray(),
      true,
      true,
      0);

    flex.SetScene(scene);
  }

  void DrawFlex(Grasshopper.GUI.Canvas.GH_Canvas conv)
  {
    if(!Go || flex == null || !flex.IsReady() || !flex.Scene.IsValid())
    {
      return;
    }

    System.Drawing.Brush b = new System.Drawing.SolidBrush(Col);

    i++;
    Rhino.RhinoApp.WriteLine("i " + i);

    flex.SetCollisionGeometry(CollisionGeometry());
    if(Shoot && i % shootIter == 0)
    {
      AddParticles();
    }

    List<FlexCLI.FlexParticle> parts = flex.Scene.GetAllParticles();


    if(parts.Count > 0)
    {
      Rhino.RhinoApp.WriteLine("numParts = " + parts.Count);
      for(int j = 0; j < parts.Count; j++){
        conv.Graphics.FillEllipse(b, parts[j].PositionX, parts[j].PositionZ, partRadius * 2.0f, partRadius * 2.0f);
      }
    }

    flex.UpdateSolver();
    Grasshopper.Instances.ActiveCanvas.Invalidate();
  }


  FlexCLI.FlexCollisionGeometry CollisionGeometry()
  {
    FlexCLI.FlexCollisionGeometry geom = new FlexCLI.FlexCollisionGeometry();

    //floor plane
    Rhino.Geometry.Plane ppp = new Rhino.Geometry.Plane(
      new Point3d(
      0.0, 0.0,
      (double) viewport.ZoomInverse * (viewport.Height - viewport.Ty)),
      new Vector3d(0.0, 0.0, -1.0));
    double[] pe = ppp.GetPlaneEquation();
    geom.AddPlane((float) pe[0], (float) pe[1], (float) pe[2], (float) pe[3]);

    //left plane
    ppp = new Rhino.Geometry.Plane(
      new Point3d(
      (double) -viewport.Tx * viewport.ZoomInverse,
      0.0, 0.0),
      new Vector3d(1.0, 0.0, 0.0));
    pe = ppp.GetPlaneEquation();
    geom.AddPlane((float) pe[0], (float) pe[1], (float) pe[2], (float) pe[3]);

    //ceiling
    ppp = new Rhino.Geometry.Plane(
      new Point3d(
      0.0, 0.0,
      (double) viewport.ZoomInverse * -viewport.Ty),
      new Vector3d(0.0, 0.0, 1.0));
    pe = ppp.GetPlaneEquation();
    geom.AddPlane((float) pe[0], (float) pe[1], (float) pe[2], (float) pe[3]);

    //right plane
    ppp = new Rhino.Geometry.Plane(
      new Point3d(
      (double) viewport.ZoomInverse * (viewport.Width - viewport.Tx),
      0.0, 0.0),
      new Vector3d(-1.0, 0.0, 0.0));
    pe = ppp.GetPlaneEquation();
    geom.AddPlane((float) pe[0], (float) pe[1], (float) pe[2], (float) pe[3]);

    //boxes
    foreach( var objj in Grasshopper.Instances.ActiveCanvas.Document.Objects)
    {
      geom.AddBox(
        new float[3]{
        (float) objj.Attributes.Bounds.Width * 0.5f,
        9999999.9f,
        (float) objj.Attributes.Bounds.Height * 0.5f},
        new float[3]{
        (float) objj.Attributes.Bounds.X + (float) objj.Attributes.Bounds.Width * 0.5f,
        0.0f,
        (float) objj.Attributes.Bounds.Y + (float) objj.Attributes.Bounds.Height * 0.5f},
        new float[4]{
        0.0f,0.0f,0.0f,1.0f});

    }



    return geom;
  }
# ---------- end c_script ----------

complex_conjugate = ComplexConjugate()
offsets = OffsetOnSrf(Distance=1)
