# Grasshopper definition 01_collisions.gh (Grasshopper 1.0.7)
# plug-ins: FlexHopper

# ----
# Random Points
number_slider = Slider(100, range=0.001..200)
dom = ConstructDomain(DomainStart=expr("x*-1", number_slider), DomainEnd=number_slider)
random = Random(Range=dom, Number=expr("x*3", Slider(500, range=1..10000)), Seed=Slider(2, range=0..50))
partition = PartitionList(List=random, Size=3)
item = ListItem(List=partition, Index=0, Wrap=True)  # -> Item, Item1, Item2
addition = Addition(A=item.Item2, B=number_slider)
pt = ConstructPoint(XCoordinate=item.Item, YCoordinate=item.Item1, ZCoordinate=addition)  # -> flatten(Point)

xz = XZPlane(Origin=Point(0, 0, 0))
yz = YZPlane(Origin=Point(0, 0, 0))
rotate = Rotate(Geometry=xz, Angle=Slider(-1, range=-3.1415..3.1416), Plane=yz)  # -> Geometry, Transform
vec = VectorXYZ(XComponent=0, YComponent="100", ZComponent=0)  # -> Vector, Length
move = Move(Geometry=rotate.Geometry, Motion=vec.Vector)  # -> Geometry, Transform
rotate_2 = Rotate(Geometry=move.Geometry, Angle=[0, 1.570796327, 3.141592654, 4.71238898], Plane=PlaneXY(0, 0, 0))  # -> Geometry, Transform

xy = XYPlane(Origin=Point(0, 0, 0))

number_slider_2 = Slider(55.217, range=0.001..200)
number_slider_3 = Slider(3, range=1..5)
dom_2 = ConstructDomain(DomainStart=expr("x*-1", number_slider_2), DomainEnd=number_slider_2)
range = Range(Domain=dom_2, Steps=expr("x-1", number_slider_3))
random_2 = Random(Range=Domain(0, 1), Number=expr("x*x*x*3", number_slider_3), Seed=2)
partition_2 = PartitionList(List=random_2, Size=3)
addition_2 = Addition(A=range, B=number_slider_2)
pt_2 = ConstructPoint(XCoordinate=range, YCoordinate=graft(range), ZCoordinate=0)
Z = UnitZ(Factor=addition_2)
item_2 = ListItem(List=partition_2, Index=0, Wrap=True)  # -> Item, Item1, Item2
move_2 = Move(Geometry=flatten(pt_2), Motion=graft(Z))  # -> flatten(Geometry), Transform
vec_2 = VectorXYZ(XComponent=item_2.Item, YComponent=item_2.Item1, ZComponent=item_2.Item2)  # -> flatten(Vector), Length
pl = PlaneNormal(Origin=move_2.Geometry, ZAxis=vec_2.Vector)

# ----
# Colliding Boxes
toggle = BooleanToggle(True)
number_slider_4 = Slider(6.9, range=0..50)
avr = Average(Input=pt)
filter = StreamFilter(Gate=toggle, Stream0=avr, Stream1=pl)
box = CenterBox(Base=filter, X=number_slider_4, Y=number_slider_4, Z=number_slider_4)

# ----
# Random Points
number_slider_5 = Slider(100, range=0.001..200)  # disabled
number_slider_6 = Slider(3810, range=1..10000)  # disabled
number_slider_7 = Slider(2, range=0..50)  # disabled
dom_3 = ConstructDomain(DomainStart=expr("x*-1", number_slider_5), DomainEnd=number_slider_5)  # disabled
random_3 = Random(Range=dom_3, Number=expr("x*3", number_slider_6), Seed=number_slider_7)  # disabled
partition_3 = PartitionList(List=random_3, Size=3)  # disabled
item_3 = ListItem(List=partition_3, Index=0, Wrap=True)  # -> Item, Item1, Item2; disabled
addition_3 = Addition(A=item_3.Item2, B=number_slider_5)  # disabled
pt_3 = ConstructPoint(XCoordinate=item_3.Item, YCoordinate=item_3.Item1, ZCoordinate=addition_3)  # -> flatten(Point); disabled

pln = Plane([rotate_2.Geometry, xy])

number_slider_8 = Slider(3, range=1..5)  # disabled
number_slider_9 = Slider(55.217, range=0.001..200)  # disabled
dom_4 = ConstructDomain(DomainStart=expr("x*-1", number_slider_9), DomainEnd=number_slider_9)  # disabled
range_2 = Range(Domain=dom_4, Steps=expr("x-1", number_slider_8))  # disabled
random_4 = Random(Range=Domain(0, 1), Number=expr("x*x*x*3", number_slider_8), Seed=2)  # disabled
partition_4 = PartitionList(List=random_4, Size=3)  # disabled
addition_4 = Addition(A=range_2, B=number_slider_9)  # disabled
pt_4 = ConstructPoint(XCoordinate=range_2, YCoordinate=graft(range_2), ZCoordinate=0)  # disabled
Z_2 = UnitZ(Factor=addition_4)  # disabled
item_4 = ListItem(List=partition_4, Index=0, Wrap=True)  # -> Item, Item1, Item2; disabled
move_3 = Move(Geometry=flatten(pt_4), Motion=graft(Z_2))  # -> flatten(Geometry), Transform; disabled
vec_3 = VectorXYZ(XComponent=item_4.Item, YComponent=item_4.Item1, ZComponent=item_4.Item2)  # -> flatten(Vector), Length; disabled
pl_2 = PlaneNormal(Origin=move_3.Geometry, ZAxis=vec_3.Vector)  # disabled

# ----
# Colliding Boxes
toggle_2 = BooleanToggle(True)  # disabled
number_slider_10 = Slider(6.9, range=0..50)  # disabled
avr_2 = Average(Input=pt_3)  # disabled
filter_2 = StreamFilter(Gate=toggle_2, Stream0=avr_2, Stream1=pl_2)  # disabled
box_2 = CenterBox(Base=filter_2, X=number_slider_10, Y=number_slider_10, Z=number_slider_10)  # disabled

swatch = ColourSwatch(SwatchColor=RGBA(0, 0, 0, 32))  # disabled
number_slider_11 = Slider(10, range=0.01..20)
number_slider_12 = Slider(2.185, range=0.01..10)
number_slider_13 = Slider(3.615, range=0..30)
number_slider_14 = Slider(4, range=0..10)
number_slider_15 = Slider(0, range=0..10)
particles = ParticlesFromPoints(Points=pt, SelfCollision=Toggle(True))

number_slider_16 = Slider(-1.0554, range=-3.1415..3.1416)  # disabled
xz_2 = XZPlane(Origin=Point(0, 0, 0))  # disabled
yz_2 = YZPlane(Origin=Point(0, 0, 0))  # disabled
panel = Panel("100")  # disabled
rotate_3 = Rotate(Geometry=xz_2, Angle=number_slider_16, Plane=yz_2)  # -> Geometry, Transform; disabled
vec_4 = VectorXYZ(XComponent=0, YComponent=panel, ZComponent=0)  # -> Vector, Length; disabled
move_4 = Move(Geometry=rotate_3.Geometry, Motion=vec_4.Vector)  # -> Geometry, Transform; disabled
rotate_4 = Rotate(Geometry=move_4.Geometry, Angle=[0, 1.570796327, 3.141592654, 4.71238898], Plane=PlaneXY(0, 0, 0))  # -> Geometry, Transform; disabled

xy_2 = XYPlane(Origin=Point(0, 0, 0))  # disabled
pln_2 = Plane(rotate_4.Geometry)  # disabled

toggle_3 = BooleanToggle(True)  # disabled
parameters = FlexParametersFromValues(
    Gravity=Vector(0, 0, -9.81),
    Radius=number_slider_11,
    SolidRestDistance=number_slider_12,
    FluidRestDistance=0.1,
    CollisionDistance=number_slider_13,
    ParticleCollisionMargin=number_slider_14,
    ShapeCollisionMargin=number_slider_15,
    MaxSpeed=3.402823466e+38,
    MaxAcceleration=100,
    DynamicFriction=Slider(0, range=0..10),
    StaticFriction=0,
    ParticleFriction=0,
    Restitution=0,
    Adhesion=0,
    SleepThreshold=0,
    ShockPropagation=0,
    Dissipation=0,
    Damping=0,
    Fluid=True,
    Viscosity=0,
    Cohesion=0.025,
    SurfaceTension=0,
    SolidPressure=1,
    FreeSurfaceDrag=0,
    Buoyancy=1,
    PlasticThreshold=0,
    PlasticCreep=0,
    Wind=Vector(0, 0, 0),
    Drag=0,
    Lift=0,
    RelaxationMode=True,
    RelaxationFactor=1)
particles_2 = ParticlesFromPoints(Positions=pt_3, SelfCollision=toggle_3)  # disabled
scene = FlexScene(Particles=flatten(particles))
opts = FlexSolverOptions(
    TimeStep=Slider(0.04, range=1e-05..0.2),
    SubSteps=3,
    NumIterations=3,
    SceneMode=0,
    FixedNumberOfIteration=-1,
    MemoryRequirements=[131072, 96, 65536, 65536, 65536, 65536, 65536, 196608, 131972],
    StabilityScale=1)
number_slider_17 = Slider(10, range=0.01..20)  # disabled
number_slider_18 = Slider(2.826, range=0.01..10)  # disabled
number_slider_19 = Slider(0.917, range=0..30)  # disabled
number_slider_20 = Slider(0.823, range=0..1)  # disabled
scene_2 = FlexScene(Particles=flatten(particles_2))  # disabled
preview_spheres = BooleanToggle(False)
button = Button()  # disabled
toggle_4 = BooleanToggle(False)  # disabled
opts_2 = FlexSolverOptions(
    TimeStep=0.04,
    SubSteps=3,
    NumIterations=3,
    SceneMode=0,
    FixedNumberOfIteration=-1,
    MemoryRequirements=[131072, 96, 65536, 65536, 65536, 65536, 65536, 196608, 131972],
    StabilityScale=1)  # disabled
particles_3 = GetParticleDescription(N=1)
parameters_2 = FlexParametersFromValues(
    Gravity=Vector(0, 0, -9.81),
    Radius=number_slider_17,
    SolidRestDistance=number_slider_18,
    FluidRestDistance=0.1,
    CollisionDistance=number_slider_19,
    ParticleCollisionMargin=0.5,
    ShapeCollisionMargin=0.5,
    MaxSpeed=3.402823466e+38,
    MaxAcceleration=100,
    DynamicFriction=number_slider_20,
    StaticFriction=0,
    ParticleFriction=0,
    Restitution=0,
    Adhesion=0,
    SleepThreshold=0,
    ShockPropagation=0,
    Dissipation=0,
    Damping=0,
    Fluid=True,
    Viscosity=0,
    Cohesion=0.025,
    SurfaceTension=0,
    SolidPressure=1,
    FreeSurfaceDrag=0,
    Buoyancy=1,
    PlasticThreshold=0,
    PlasticCreep=0,
    Wind=Vector(0, 0, 0),
    Drag=0,
    Lift=0,
    RelaxationMode=True,
    RelaxationFactor=1)  # disabled
swatch_2 = ColourSwatch(SwatchColor=RGB(58, 164, 240))

flip_faces = BooleanToggle(False)
vec_5 = VectorXYZ(
    XComponent=expr("x*0.7", number_slider),
    YComponent=expr("x*0.7", number_slider),
    ZComponent=expr("x*0.7", number_slider))  # -> Vector, Length
msphereex = MeshSphereEx(Base=PlaneXY(0, 0, 0), Radius=Slider(100, range=0..200), Count=5)
move_5 = Move(Geometry=msphereex, Motion=vec_5.Vector)  # -> Geometry, Transform

# ----
# Triangulate & Clean Up
tri = Triangulate(Mesh=move_5.Geometry)  # -> Mesh, Count

weld = WeldMesh(Mesh=tri.Mesh, Angle=3.141592654)

# ----
# Flip Face Directions
demesh = DeconstructMesh(Mesh=weld)  # -> Vertices, Faces, Colours, Normals
deface = DeconstructFace(Face=demesh.Faces)  # -> CornerA, CornerB, CornerC, CornerD
triangle = MeshTriangle(CornerA=deface.CornerA, CornerB=deface.CornerC, CornerC=deface.CornerB)
conmesh = ConstructMesh(Vertices=demesh.Vertices, Faces=triangle)

filter_3 = StreamFilter(Gate=flip_faces, Stream1=conmesh)

facen = FaceNormals(Mesh=filter_3)  # -> Centers, Normals
preview = CustomPreview(Geometry=filter_3, Shader=ColourSwatch(SwatchColor=RGBA(0, 0, 0, 32)))
vdis = VectorDisplay(Anchor=facen.Centers, Vector=expr("x*10", facen.Normals))
collgeometry = FlexCollisionGeometry(CollisionPlanes=flatten(pln), CollisionBoxes=flatten(box), CollisionMeshes=flatten(filter_3))
flex = FlexEngine(
    FlexParams=parameters,
    FlexCollisionGeometry=collgeometry,
    FlexScene=flatten(scene),
    FlexSolverOptions=opts,
    Reset=Button(),
    Go=Toggle(False))  # -> FlexObject, Information
gate = StreamGate(Stream=flex.FlexObject, Gate=preview_spheres)  # -> Target0, Target1

# ----
# Visualisation
allparts = GetAllParticles(FlexObject=gate.Target1, N=1)  # -> Points, Vector
detail = Slider(4, range=2..8)
msphereex_2 = MeshSphereEx(Base=allparts.Points, Radius=expr("x*0.5", number_slider_11), Count=detail)
msphereex_3 = MeshSphereEx(Base=allparts.Points, Radius=expr("x*0.5", number_slider_12), Count=detail)
msphereex_4 = MeshSphereEx(Base=allparts.Points, Radius=number_slider_13, Count=detail)
msphereex_5 = MeshSphereEx(Base=allparts.Points, Radius=number_slider_14, Count=detail)
msphereex_6 = MeshSphereEx(Base=allparts.Points, Radius=number_slider_15, Count=detail)
preview_2 = CustomPreview(Geometry=msphereex_2, Shader=ColourSwatch(SwatchColor=RGBA(0, 187, 255, 169)))
preview_3 = CustomPreview(Geometry=msphereex_3, Shader=ColourSwatch(SwatchColor=RGBA(255, 0, 0, 200)))
preview_4 = CustomPreview(Geometry=msphereex_4, Shader=ColourSwatch(SwatchColor=RGBA(255, 82, 82, 98)))
preview_5 = CustomPreview(Geometry=msphereex_5, Shader=ColourSwatch(SwatchColor=RGB(255, 251, 0)))
preview_6 = CustomPreview(Geometry=msphereex_6, Shader=ColourSwatch(SwatchColor=RGBA(255, 253, 122, 84)))

allparts_2 = GetAllParticles(FlexObject=gate.Target0, N=1)  # -> Points, Vector

flip_faces_2 = BooleanToggle(False)  # disabled
number_slider_21 = Slider(49.87, range=0..200)  # disabled
vec_6 = VectorXYZ(
    XComponent=expr("x*0.7", number_slider_5),
    YComponent=expr("x*0.7", number_slider_5),
    ZComponent=expr("x*0.7", number_slider_5))  # -> Vector, Length; disabled
msphereex_7 = MeshSphereEx(Base=PlaneXY(0, 0, 0), Radius=number_slider_21, Count=5)  # disabled
move_6 = Move(Geometry=msphereex_7, Motion=vec_6.Vector)  # -> Geometry, Transform; disabled

# ----
# Triangulate & Clean Up
tri_2 = Triangulate(Mesh=move_6.Geometry)  # -> Mesh, Count; disabled

weld_2 = WeldMesh(Mesh=tri_2.Mesh, Angle=3.141592654)  # disabled

# ----
# Flip Face Directions
demesh_2 = DeconstructMesh(Mesh=weld_2)  # -> Vertices, Faces, Colours, Normals; disabled
deface_2 = DeconstructFace(Face=demesh_2.Faces)  # -> CornerA, CornerB, CornerC, CornerD; disabled
triangle_2 = MeshTriangle(CornerA=deface_2.CornerA, CornerB=deface_2.CornerC, CornerC=deface_2.CornerB)  # disabled
conmesh_2 = ConstructMesh(Vertices=demesh_2.Vertices, Faces=triangle_2)  # disabled

filter_4 = StreamFilter(Gate=flip_faces_2, Stream0=weld_2, Stream1=conmesh_2)  # disabled

facen_2 = FaceNormals(Mesh=filter_4)  # -> Centers, Normals; disabled
preview_7 = CustomPreview(Geometry=filter_4, Shader=swatch)  # disabled
vdis_2 = VectorDisplay(Anchor=facen_2.Centers, Vector=expr("x*10", facen_2.Normals))  # disabled
collgeometry_2 = FlexCollisionGeometry(CollisionPlanes=flatten(pln_2), CollisionBoxes=flatten(box_2), CollisionMeshes=flatten(filter_4))  # disabled
flex_2 = FlexEngine(
    FlexParams=parameters_2,
    FlexCollisionGeometry=collgeometry_2,
    FlexScene=flatten(scene_2),
    FlexSolverOptions=opts_2,
    Reset=button,
    Go=toggle_4)  # -> FlexObject, Information; disabled
allparts_3 = GetAllParticles(FlexObject=flex_2.FlexObject, N=1)  # -> Points, Vector; disabled
panel_2 = Panel(flex_2.Information)  # disabled
bake = InstantBake(Objects=flatten(allparts_3.Points), LayerName="Default", ClearLayer=False)  # disabled
