# Grasshopper definition 01a_fluids.gh (Grasshopper 0.9.76)
# plug-ins: FlexHopper

number_slider = Slider(100, range=10..200)
number_slider_2 = Slider(60, range=10..200)
dom = ConstructDomain(DomainStart=expr("x*-1", number_slider_2), DomainEnd=number_slider_2)
dom_2 = ConstructDomain(DomainStart=expr("x*-1", number_slider), DomainEnd=number_slider)
range = Range(Domain=dom_2, Steps=Slider(50, range=5..200))
item = ListItem(List=range, Index=0, Wrap=True)  # -> Item, Item1
Z = UnitZ(Factor=Slider(22.844, range=0..100))
subtraction = Subtraction(A=item.Item1, B=item.Item)
panel = Panel("""-1
0
1
0""")
abs = Absolute(Value=subtraction)
series = Series(Start=abs, Step=abs, Count=Slider(5, range=1..20))
Z_2 = UnitZ(Factor=series)
panel_2 = Panel("""0
-1
0
1""")
division = Division(A=number_slider_2, B=abs)
multiplication = Multiplication(A=Slider(100, range=10..200), B=panel_2)
multiplication_2 = Multiplication(A=Slider(107.89, range=10..200), B=panel)
pt = ConstructPoint(XCoordinate=multiplication_2, YCoordinate=multiplication, ZCoordinate=0)
range_2 = Range(Domain=dom, Steps=expr("x*2", division))
pt_2 = ConstructPoint(XCoordinate=graft(range), YCoordinate=range_2, ZCoordinate=0)  # -> flatten(Point)
move = Move(Geometry=pt_2, Motion=graft(Z_2))  # -> flatten(Geometry), Transform
lng = ListLength(List=move.Geometry)
move_2 = Move(Geometry=move.Geometry, Motion=Z)  # -> Geometry, Transform
panel_3 = Panel(lng)
entwine = Entwine(Branch00=move.Geometry, Branch01=move_2.Geometry, FlattenInputs=True)

# ----
# The timer is used for two things:
# 1 - Make the fountain emit new
#       particles at every tick
# 2 - Increase the group index every
#       other iteration to get colored
#       groups
# Particles per group
# Reset this recorder every
# once in a while
panel_4 = Panel("2000")
division_2 = Division(A=20, B=panel_4)
num = Number(division_2)
rec = DataRecorder(num, DataLimit=-10, RecordData=True)
ma = MassAddition(Input=rec)  # -> Result, PartialResults

# ----
# Collision planes
Y = UnitY(Factor=1)
X = UnitX(Factor=1)
Y_2 = UnitY(Factor=1)  # -> expr("x*-1", UnitVector)
X_2 = UnitX(Factor=1)  # -> expr("x*-1", UnitVector)
pt_3 = Point(pt)
merge = Merge(Data1=X, Data2=Y, Data3=X_2, Data4=Y_2)
xy = XYPlane(Origin=Point(0, 0, 0))
pl = PlaneNormal(Origin=pt_3, ZAxis=merge)
collgeometry = FlexCollisionGeometry(CollisionPlanes=flatten([xy, pl]))

toggle = BooleanToggle(True)

# ----
# Particle Fountain
particles = ParticlesFromPoints(Positions=move.Geometry, Masses=Slider(1, range=0..1), SelfCollision=toggle, IsFluid=toggle, GroupIndex="0")

scene = FlexScene(Particles=flatten(particles))
parameters = FlexParametersFromValues(
    Gravity=Vector(0, 0, -9.81),
    Radius=expr("x*1.33333*2", abs),
    SolidRestDistance=0.15,
    FluidRestDistance=expr("x*2", abs),
    CollisionDistance=0.075,
    ParticleCollisionMargin=0.5,
    ShapeCollisionMargin=0.5,
    MaxSpeed=3.402823466e+38,
    MaxAcceleration=100,
    DynamicFriction=0,
    StaticFriction=0,
    ParticleFriction=0,
    Restitution=0,
    Adhesion=0,
    SleepThreshold=0,
    ShockPropagation=0,
    Dissipation=0,
    Damping=0,
    Fluid=True,
    Viscosity=Slider(0, range=0..10),
    Cohesion=Slider(0.025, range=0..10),
    SurfaceTension=Slider(0, range=0..10),
    SolidPressure=1,
    FreeSurfaceDrag=0,
    Buoyancy=1,
    PlasticThreshold=0,
    PlasticCreep=0,
    Wind=Vector(0, 0, 0),
    Drag=0,
    Lift=0,
    RelaxationMode=True,
    RelaxationFactor=1)
opts = FlexSoverOptions(TimeStep=Slider(0.2, range=0..0.3), SubSteps=3, NumIterations=3)
flex = FlexEngine(
    FlexParams=parameters,
    FlexCollisionGeometry=collgeometry,
    FlexScene=flatten(scene),
    FlexSolverOptions=opts,
    LockMode=False,
    Reset=Button(),
    Go=Toggle(True))  # -> FlexObject, Information
panel_5 = Panel(flex.Information)
allparts = GetAllParticles(FlexObject=flex.FlexObject, N=Slider(1, range=1..20))  # -> Points, Vector
msphereex = MeshSphereEx(Base=allparts.Points, Radius=division, Count=2)  # disabled

# ----
# Assign color based
# on tree branch index
tstat = TreeStatistics(Tree=allparts.Points)  # -> Paths, Length, Count; disabled
range_3 = Range(Domain=Domain(0, 1), Steps=tstat.Count)
hsl = ColourHSL(Alpha=1, Hue=range_3, Saturation=1, Luminance=0.5)  # -> graft(Colour)

preview = CustomPreview(Geometry=msphereex, Shader=ColourSwatch(SwatchColor=RGBA(212, 212, 212, 47)))
cloud = CloudDisplay(Points=allparts.Points, Colours=graft(ColourSwatch(SwatchColor=RGB(255, 255, 255))), Size=abs, SpriteType=0)
item_2 = ListItem(List=tstat.Paths, Index=Slider(0, range=0..30), Wrap=True)
branch = TreeBranch(Tree=allparts.Points, Path=item_2, MaintainPaths=True)  # disabled

# ----
# Enable us when needed
# we're pretty slow
preview_2 = CustomPreview(Geometry=allparts.Points, Shader=hsl)
vdisex = VectorDisplayEx(Point=allparts.Points, Vector=allparts.Vector, Colour=hsl, Width=1)
