# Grasshopper definition 02_fluids_a.gh (Grasshopper 1.0.7)
# plug-ins: FlexHopper

number_slider = Slider(109.59, range=10..200)
number_slider_2 = Slider(60, range=10..200)

# ----
# Particle Distance
dom = ConstructDomain(DomainStart=expr("x*-1", number_slider_2), DomainEnd=number_slider_2)
dom_2 = ConstructDomain(DomainStart=expr("x*-1", number_slider), DomainEnd=number_slider)
range = Range(Domain=dom_2, Steps=Slider(50, range=5..200))
item = ListItem(List=range, Index=0, Wrap=True)  # -> Item, Item1
subtraction = Subtraction(A=item.Item1, B=item.Item)
abs = Absolute(Value=subtraction)
particle_distance = Number(abs)

# ----
# Generate Particles
division = Division(A=number_slider_2, B=particle_distance)
range_2 = Range(Domain=dom, Steps=expr("x*2", division))
series = Series(Start=particle_distance, Step=particle_distance, Count=Slider(5, range=1..20))
pt = ConstructPoint(XCoordinate=graft(range), YCoordinate=range_2, ZCoordinate=0)  # -> flatten(Point)
Z = UnitZ(Factor=series)
move = Move(Geometry=pt, Motion=graft(Z))  # -> flatten(Geometry), Transform
lng = ListLength(List=move.Geometry)
panel = Panel(lng)

# ----
# Collision planes
panel_2 = Panel("""-1
0
1
0""")
panel_3 = Panel("""0
-1
0
1""")
multiplication = Multiplication(A=Slider(148.76, range=10..200), B=panel_2)
multiplication_2 = Multiplication(A=Slider(160.84, range=10..200), B=panel_3)
Y = UnitY(Factor=1)
X = UnitX(Factor=1)
Y_2 = UnitY(Factor=1)  # -> expr("x*-1", UnitVector)
X_2 = UnitX(Factor=1)  # -> expr("x*-1", UnitVector)
pt_2 = ConstructPoint(XCoordinate=multiplication, YCoordinate=multiplication_2, ZCoordinate=0)
merge = Merge(Data1=X, Data2=Y, Data3=X_2, Data4=Y_2)
pt_3 = Point(pt_2)
xy = XYPlane(Origin=Point(0, 0, 0))
pl = PlaneNormal(Origin=pt_3, ZAxis=merge)
collgeometry = FlexCollisionGeometry(CollisionPlanes=flatten([xy, pl]))

toggle = BooleanToggle(True)
particles = ParticlesFromPoints(Positions=move.Geometry, Masses=Slider(1, range=0..1), SelfCollision=toggle, IsFluid=toggle)
scene = FlexScene(Particles=flatten(particles))
parameters = FlexParametersFromValues(
    Gravity=Vector(0, 0, -9.81),
    Radius=expr("x*1.33333*2", particle_distance),
    SolidRestDistance=0.15,
    FluidRestDistance=expr("x*2", particle_distance),
    CollisionDistance=0.075,
    ParticleCollisionMargin=0.5,
    ShapeCollisionMargin=0.5,
    MaxSpeed=3.402823466e+38,
    MaxAcceleration=100,
    DynamicFriction=0,
    StaticFriction=0,
    ParticleFriction=0,
    Restitution=0,
    Adhesion=0,
    SleepThreshold=0,
    ShockPropagation=0,
    Dissipation=0,
    Damping=0,
    Fluid=True,
    Viscosity=Slider(0, range=0..10),
    Cohesion=Slider(0.025, range=0..10),
    SurfaceTension=Slider(0, range=0..10),
    SolidPressure=1,
    FreeSurfaceDrag=0,
    Buoyancy=1,
    PlasticThreshold=0,
    PlasticCreep=0,
    Wind=Vector(0, 0, 0),
    Drag=0,
    Lift=0,
    RelaxationMode=True,
    RelaxationFactor=1)
opts = FlexSoverOptions(
    TimeStep=Slider(0.2, range=0..0.3),
    SubSteps=3,
    NumIterations=3,
    SceneMode=0,
    FixedNumberOfIteration=-1,
    MemoryRequirements=[131072, 96, 65536, 65536, 65536, 65536, 65536, 196608, 131972],
    StabilityScale=1)
flex = FlexEngine(
    FlexParams=parameters,
    FlexCollisionGeometry=collgeometry,
    FlexScene=flatten(scene),
    FlexSolverOptions=opts,
    Reset=Button(),
    Go=Toggle(False))  # -> FlexObject, Information
panel_4 = Panel(flex.Information)
allparts = GetAllParticles(FlexObject=flex.FlexObject, N=Slider(1, range=1..20))  # -> Points, Vector
msphereex = MeshSphereEx(Base=allparts.Points, Radius=division, Count=2)  # disabled
cloud = CloudDisplay(
    Points=allparts.Points,
    Colours=graft(ColourSwatch(SwatchColor=RGB(255, 255, 255))),
    Size=particle_distance,
    SpriteType=0)
preview = CustomPreview(Geometry=msphereex, Shader=ColourSwatch(SwatchColor=RGBA(212, 212, 212, 47)))
