# Grasshopper definition 02_rigid_aggregates.gh (Grasshopper 0.9.76)
# plug-ins: FlexHopper

number_slider = Slider(10, range=0..20)
panel = Panel("""sqrt(8/9)
-sqrt(2/9)
-sqrt(2/9)
0""")
panel_2 = Panel("""0
sqrt(2/3)
-sqrt(2/3)
0""")
panel_3 = Panel("""-1/3
-1/3
-1/3
1""")
vec = VectorXYZ(XComponent=panel, YComponent=panel_2, ZComponent=panel_3)  # -> Vector, Length
xy = XYPlane(Origin=Point(0, 0, 0))
pl = PlaneNormal(Origin=Point(0, 0, 0), ZAxis=vec.Vector)
line = LineSDL(Start=xy, Direction=vec.Vector, Length=number_slider)
custom_mesh_settings = SettingsCustom(
    StitchSeams=True,
    SimplePlanes=False,
    Refine=True,
    MinCount=16,
    MaxCount=400,
    AspectRatio=Slider(3.31, range=0..5),
    MaxDistance=Slider(5, range=0..5),
    MaxAngle=20,
    MinEdge=Slider(0.4, range=0..5),
    MaxEdge=Slider(0.72, range=0..5))
cone = Cone(Base=pl, Radius=0.5, Length=number_slider)  # -> Cone, Tip
mesh = MeshBrep(Brep=cone.Cone, Settings=custom_mesh_settings)
weld = WeldMesh(Mesh=mesh, Angle=3.141592654)

number_slider_2 = Slider(10, range=0..20)
X = UnitX(Factor=1)
Y = UnitY(Factor=1)
Z = UnitZ(Factor=1)
merge = Merge(Data1=X, Data2=Y, Data3=Z)
merge_2 = Merge(Data1=X, Data2=Y, Data3=Z)
xy_2 = XYPlane(Origin=Point(0, 0, 0))
multiplication = Multiplication(A=merge, B=-1)
line_2 = LineSDL(Start=xy_2, Direction=[merge_2, multiplication], Length=number_slider_2)

number_slider_3 = Slider(2.4, range=1..10)
divide = DivideCurve(Curve=line_2, Count=Slider(6, range=2..20), Kinks=False)  # -> Points, Tangents, Parameters
item = ListItem(List=flatten(divide.Points), Index=0, Wrap=True)  # -> Item, Item1
split = SplitList(List=divide.Points, Index=1)  # -> ListA, ListB
pt = Point(flatten(split.ListB))
dist = Distance(PointA=item.Item, PointB=item.Item1)
msphereex = MeshSphereEx(Base=pt, Radius=dist, Count=5)
num = Number(number_slider_2)
num_2 = Number(Slider(0.2, range=0.001..1))
lng = ListLength(List=pt)
merge_3 = Merge(Data1=num, Data2=num_2, Data3=num_2)
merge_4 = Merge(Data1=num_2, Data2=num, Data3=num_2)
merge_5 = Merge(Data1=num_2, Data2=num_2, Data3=num)
pt_2 = ConstructPoint(XCoordinate=0, YCoordinate=Slider(60, range=0..200), ZCoordinate=0)
xz = XZPlane(Origin=pt_2)
box = CenterBox(Base=PlaneXY(0, 0, 0), X=merge_3, Y=merge_4, Z=merge_5)
rotate = Rotate(Geometry=xz, Angle=[0, 1.570796327, 3.141592654, 4.71238898], Plane=PlaneXY(0, 0, 0))  # -> Geometry, Transform
sunion = SolidUnion(Breps=box)
mesh_2 = MeshBrep(
    Brep=sunion,
    Settings={GridMaxCount=0, GridMinCount=16, JaggedSeams=False, MaxEdgeLength=0, MinEdgeLength=0.0001, MinTolerance=0, Refine=True, RefineAngle=0, RelativeTolerance=0.65, SimplePlanes=True, Tolerance=0})
weld_2 = WeldMesh(Mesh=mesh_2, Angle=3.141592654)

opts = FlexSolverOptions(TimeStep=Slider(0.02, range=0..0.4), SubSteps=Slider(15, range=1..20), NumIterations=Slider(15, range=1..20))

xy_3 = XYPlane(Origin=Point(0, 0, 0))
radius = Number(dist)
number_slider_4 = Slider(0.8, range=0..1)
collgeometry = FlexCollisionGeometry(CollisionPlanes=flatten([xy_3, rotate.Geometry]))
parameters = FlexParametersFromValues(
    Gravity=Vector(0, 0, -9.81),
    Radius=radius,
    SolidRestDistance=radius,
    FluidRestDistance=0.1,
    CollisionDistance=radius,
    ParticleCollisionMargin=expr("x*2", radius),
    ShapeCollisionMargin=0.5,
    MaxSpeed=3.402823466e+38,
    MaxAcceleration=100,
    DynamicFriction=number_slider_4,
    StaticFriction=0,
    ParticleFriction=number_slider_4,
    Restitution=0,
    Adhesion=0,
    SleepThreshold=0,
    ShockPropagation=Slider(0.001, range=0..1),
    Dissipation=0,
    Damping=Slider(0.1, range=0..1),
    Fluid=True,
    Viscosity=0,
    Cohesion=0.025,
    SurfaceTension=0,
    SolidPressure=1,
    FreeSurfaceDrag=0,
    Buoyancy=1,
    PlasticThreshold=0,
    PlasticCreep=0,
    Wind=Vector(0, 0, 0),
    Drag=0,
    Lift=0,
    RelaxationMode=True,
    RelaxationFactor=1)

# ----
# Random Points
number_slider_5 = Slider(50, range=0.001..200)
number_slider_6 = Slider(500, range=1..10000)
number_slider_7 = Slider(2, range=0..50)
dom = ConstructDomain(DomainStart=expr("x*-1", number_slider_5), DomainEnd=number_slider_5)
random = Random(Range=dom, Number=expr("x*3", number_slider_6), Seed=number_slider_7)
random_2 = Random(Range=Domain(-1, 1), Number=expr("x*3", number_slider_6), Seed=expr("x*3", number_slider_7))
partition = PartitionList(List=random, Size=3)
partition_2 = PartitionList(List=random_2, Size=3)
item_2 = ListItem(List=partition, Index=0, Wrap=True)  # -> Item, Item1, Item2
item_3 = ListItem(List=partition_2, Index=0, Wrap=True)  # -> Item, Item1, Item2
pt_3 = ConstructPoint(XCoordinate=item_3.Item, YCoordinate=item_3.Item1, ZCoordinate=item_3.Item2)  # -> flatten(Point)

multiplication_2 = Multiplication(A=item_2.Item2, B=number_slider_3)
multiplication_3 = Multiplication(A=number_slider_5, B=number_slider_3)

addition = Addition(A=multiplication_2, B=multiplication_3)

addition_2 = Addition(A=addition, B=Slider(30, range=0..100))

pt_4 = ConstructPoint(XCoordinate=item_2.Item, YCoordinate=item_2.Item1, ZCoordinate=addition_2)  # -> flatten(Point)

pl_2 = PlaneNormal(Origin=pt_4, ZAxis=pt_3)
orient = Orient(Geometry=pt, Source=PlaneXY(0, 0, 0), Target=graft(pl_2))  # -> Geometry, Transform
flatten = FlattenTree(Tree=orient.Geometry, Path="{0}")
lng_2 = ListLength(List=flatten)
series = Series(Start=0, Step=1, Count=lng_2)
int = Integer(series)
partition_3 = PartitionList(List=int, Size=lng)
shape_matching = ConstraintShapeMatchingConstraint(ParticleIndices=simplify(partition_3), Stiffness=Slider(0.99, range=0..1))
panel_4 = Panel(partition_3)
particles = ParticlesFromPoints(Positions=flatten, SelfCollision=Toggle(True))
scene = FlexScene(Particles=flatten(particles), LocalConstraints=flatten(shape_matching))
flex = FlexEngine(
    FlexParams=parameters,
    FlexCollisionGeometry=collgeometry,
    FlexScene=flatten(scene),
    FlexSolverOptions=opts,
    LockMode=False,
    Reset=Button(),
    Go=Toggle(False))  # -> FlexObject, Information
allparts = GetAllParticles(FlexObject=flex.FlexObject, N=1)  # -> Points, Vector; disabled
orient_2 = Orient(Geometry=weld_2, Source=PlaneXY(0, 0, 0), Target=pl_2)  # -> Geometry, Transform
cloud = CloudDisplay(Points=allparts.Points, Colours=ColourSwatch(SwatchColor=RGB(107, 100, 92)), Size=radius, SpriteType=0)
transform = GetRigidTranformations(FlexObject=flex.FlexObject)  # -> Translations, RotationVectors, RotationAngles, Transformations
transform_2 = Transform(Geometry=orient_2.Geometry, Transform=transform.Transformations)
preview = CustomPreview(Geometry=transform_2, Shader=ColourSwatch(SwatchColor=RGB(255, 255, 255)))
