# Grasshopper definition 03_fiber_winding.gh (Grasshopper 0.9.76)
# plug-ins: FlexHopper

number_slider = Slider(20, range=0..50)
number_slider_2 = Slider(40, range=0.0001..70)
pt = ConstructPoint(XCoordinate=expr("x*-1", number_slider_2), YCoordinate=0, ZCoordinate=number_slider)
pt_2 = ConstructPoint(XCoordinate=number_slider_2, YCoordinate=0, ZCoordinate=number_slider)
yz = YZPlane(Origin=[pt_2, pt])
fiber_resolution = Slider(200, range=1..200)
adjust_string = BooleanToggle(False)
reset = Button()
knob = ControlKnob(Decimals=0, Limit=True, Maximum=250, Minimum=0, Range=25, Value=0)
number_slider_3 = Slider(25, range=0..50)
go = BooleanToggle(False)
reset_2 = Button()  # disabled
go_2 = BooleanToggle(False)  # disabled
addition = Addition(A=knob, B=Slider(0, range=-15..15))
equals = Equality(FirstNumber=knob, SecondNumber=knob)  # -> Equality, Inequality
avr = Average(Input=[pt_2, pt])
ellipse = Ellipse(
    Plane=yz,
    Radius1=[Slider(25, range=0..50), Slider(15, range=0..50)],
    Radius2=[Slider(15, range=0..50), Slider(25, range=0..50)])  # -> Ellipse, Focus1, Focus2
and = GateAnd(A=equals.Equality, B=adjust_string)
rec = DataRecorder(and, DataLimit=-10, RecordData=True)
bool = Boolean(invert(rec))
number_slider_4 = Slider(13.691, range=1..100)  # disabled
int = Integer(bool)
mod = Modulus(A=[knob, addition], B=number_slider_3)
divide = DivideCurve(Curve=ellipse.Ellipse, Count=number_slider_3, Kinks=False)  # -> Points, Tangents, Parameters
ma = MassAddition(Input=int)  # -> Result, PartialResults
pipe = Pipe(Curve=ellipse.Ellipse, Radius=0.5, Caps=0)  # -> flatten(Pipe)
loft = Loft(Curves=ellipse.Ellipse, Options={Adjust=False, Closed=False, LoftEnds=0, LoftSimp=0, LoftType=0, Rebuild=10, Refit=0.01})  # disabled
panel = Panel(ma.Result)
item = ListItem(List=divide.Points, Index=graft(mod), Wrap=True)  # -> flatten(Item)
preview = CustomPreview(Geometry=pipe, Shader=ColourSwatch(SwatchColor=RGB(161, 161, 161)))
custom_mesh_settings = SettingsCustom(
    StitchSeams=True,
    SimplePlanes=False,
    Refine=True,
    MinCount=16,
    MaxCount=400,
    AspectRatio=20,
    MaxDistance=0,
    MaxAngle=20,
    MinEdge=0,
    MaxEdge=number_slider_4)  # disabled
item_2 = ListItem(List=item, Index=0, Wrap=True)  # -> Item, Item1
sph = Sphere(Base=[item_2.Item, item_2.Item1], Radius=1.5)
sph_2 = Sphere(Base=avr, Radius=Slider(8.406, range=0..30))  # disabled
mesh = MeshBrep(Brep=loft, Settings=custom_mesh_settings)  # disabled
tri = Triangulate(Mesh=mesh)  # -> Mesh, Count; disabled
avr_2 = Average(Input=[item_2.Item, item_2.Item1])
weld = WeldMesh(Mesh=tri.Mesh, Angle=3.141592654)  # disabled
demesh = DeconstructMesh(Mesh=weld)  # -> Vertices, Faces, Colours, Normals; disabled
vec2pt = Vector2Pt(PointA=avr, PointB=avr_2, Unitize=True)  # -> Vector, Length
number_slider_5 = Slider(0.001, range=0..1)  # disabled
multiplication = Multiplication(A=vec2pt.Vector, B=Slider(1, range=-1..1))
crv_cp = CurveClosestPoint(Point=demesh.Vertices, Curve=graft(ellipse.Ellipse))  # -> Point, Parameter, Distance; disabled
lng = ListLength(List=demesh.Vertices)  # disabled
multiplication_2 = Multiplication(A=multiplication, B=Slider(29.9, range=0..50))
smaller = SmallerThan(FirstNumber=crv_cp.Distance, SecondNumber=number_slider_5)  # -> SmallerThan, OrEqualTo; disabled
series = Series(Start=0, Step=1, Count=lng)  # disabled
move = Move(Geometry=avr_2, Motion=multiplication_2)  # -> Geometry, Transform
dispatch = Dispatch(List=demesh.Vertices, DispatchPattern=smaller.SmallerThan)  # -> ListA, ListB; disabled
int_2 = Integer(series)  # disabled
merge = Merge(Data1=item_2.Item, Data2=move.Geometry, Data3=item_2.Item1)
number_slider_6 = Slider(0.3, range=0..1)  # disabled
number_slider_7 = Slider(0.775, range=0..1)  # disabled
number_slider_8 = Slider(0, range=0..1)  # disabled
dispatch_2 = Dispatch(List=int_2, DispatchPattern=smaller.SmallerThan)  # -> flatten(ListA), ListB; disabled
number_slider_9 = Slider(0, range=-20..20)  # disabled
number_slider_10 = Slider(-10000, range=-10000..20)  # disabled
intcrv = Interpolate(Vertices=merge, Degree=3, Periodic=False, KnotStyle=1)  # -> Curve, Length, Domain
number_slider_11 = Slider(0, range=-20..20)  # disabled
divide_2 = DivideCurve(Curve=intcrv.Curve, Count=fiber_resolution, Kinks=False)  # -> Points, Tangents, Parameters

panel_2 = Panel("0")  # disabled
cloth = ClothFromMesh(
    ClothMeshes=weld,
    Masses=number_slider_6,
    StretchStiffness=number_slider_7,
    BendingStiffness=number_slider_8,
    PreTension=1,
    Anchors=flatten(dispatch.ListA),
    GroupIndex=panel_2)  # disabled

vec = VectorXYZ(XComponent=number_slider_9, YComponent=number_slider_10, ZComponent=number_slider_11)  # -> Vector, Length; disabled
shift = ShiftList(List=divide_2.Points, Shift=1, Wrap=False)
shift_2 = ShiftList(List=divide_2.Points, Shift=-1, Wrap=False)

# ----
# Right click me to save
# params to .xml
# Alternatively use
# "FlexParameters from .xml file"
# which is more neat
# Play with me!
number_slider_12 = Slider(0, range=-10..10)  # disabled
number_slider_13 = Slider(-9.81, range=-10..10)  # disabled
number_slider_14 = Slider(0.107, range=0..1)  # disabled
number_slider_15 = Slider(0.07, range=0..1)  # disabled
vec_2 = VectorXYZ(XComponent=number_slider_12, YComponent=0, ZComponent=number_slider_13)  # -> Vector, Length; disabled
parameters = FlexParametersFromValues(
    Gravity=vec_2.Vector,
    Radius=0.15,
    SolidRestDistance=0.075,
    FluidRestDistance=0.1,
    CollisionDistance=0.075,
    ParticleCollisionMargin=0.5,
    ShapeCollisionMargin=0.5,
    MaxSpeed=3.402823466e+38,
    MaxAcceleration=1000,
    DynamicFriction=0,
    StaticFriction=0,
    Restitution=0,
    Adhesion=0,
    SleepThreshold=0,
    ShockPropagation=0,
    Dissipation=0,
    Damping=0,
    Fluid=True,
    Viscosity=0,
    Cohesion=0.025,
    SurfaceTension=0,
    SolidPressure=1,
    FreeSurfaceDrag=0,
    Buoyancy=1,
    PlasticThreshold=0,
    PlasticCreep=0,
    Wind=vec.Vector,
    Drag=number_slider_14,
    Lift=number_slider_15,
    RelaxationMode=True,
    RelaxationFactor=1)  # disabled

dist = Distance(PointA=shift_2, PointB=shift)
int_3 = Integer(["0", fiber_resolution])
pline = PolyLine(Vertices=divide_2.Points, Closed=False)
avr_3 = Average(Input=dist)
springs = SpringSystemFromLinesMeshes(
    Springs=pline,
    TargetSpringLength=-0.01,
    SpringStiffness=0.999,
    AdditionalSheetStiffening=Toggle(True),
    SelfCollision=Toggle(False),
    Anchors=int_3,
    GroupIndex=panel)
panel_3 = Panel(avr_3)
gate = StreamGate(Stream=springs, Gate=adjust_string)  # -> Target0, Target1
scene = FlexScene(Cloths=flatten(cloth))  # disabled
parameters_2 = FlexParametersFromValues(
    Gravity=Vector(0, 0, -9.81),
    Radius=panel_3,
    SolidRestDistance=panel_3,
    FluidRestDistance=0.1,
    CollisionDistance=0.075,
    ParticleCollisionMargin=0.5,
    ShapeCollisionMargin=0.5,
    MaxSpeed=3.402823466e+38,
    MaxAcceleration=100,
    DynamicFriction=0,
    StaticFriction=0,
    ParticleFriction=Slider(10, range=0..10),
    Restitution=0,
    Adhesion=0,
    SleepThreshold=Slider(1, range=0..1),
    ShockPropagation=0,
    Dissipation=0,
    Damping=Slider(1, range=0..1),
    Fluid=True,
    Viscosity=0,
    Cohesion=0.025,
    SurfaceTension=0,
    SolidPressure=1,
    FreeSurfaceDrag=0,
    Buoyancy=1,
    PlasticThreshold=0,
    PlasticCreep=0,
    Wind=Vector(0, 0, 0),
    Drag=0,
    Lift=0,
    RelaxationMode=True,
    RelaxationFactor=1)
scene_2 = FlexScene(SpringSystems=flatten(gate.Target0))
opts = FlexSolverOptions(TimeStep=0.02, SubSteps=Slider(10, range=2..50), NumIterations=Slider(30, range=2..50))
flex = FlexEngine(FlexParams=parameters, FlexScene=flatten(scene), FlexSolverOptions=opts, LockMode=False, Reset=reset_2, Go=go_2)  # -> FlexObject, Information; disabled
swatch = ColourSwatch(SwatchColor=RGB(255, 255, 255))  # disabled
flex_2 = FlexEngine(FlexParams=parameters_2, FlexScene=flatten(scene_2), FlexSolverOptions=opts, LockMode=False, Reset=reset, Go=go)  # -> FlexObject, Information
material = CreateMaterial(Diffuse=swatch, Specular=RGB(255, 255, 255), Emission=RGB(0, 0, 0), Transparency=0, Shine=0)  # disabled
panel_4 = Panel(flex_2.Information)
cloths = GetCloths(FlexObject=flex.FlexObject, N=0, ClothObject=cloth, PreviewMaterial=material)  # -> Points, Vector, Meshes; disabled
allparts = GetAllParticles(FlexObject=flex_2.FlexObject, N=1)  # -> Points, Vector; disabled
allsprings = GetAllSprings(FlexObject=flex_2.FlexObject, N=1)
msphereex = MeshSphereEx(Base=allparts.Points, Radius=expr("x*0.5", panel_3), Count=3)
preview_2 = CustomPreview(Geometry=allsprings, Shader=ColourSwatch(SwatchColor=RGB(255, 255, 255)))
