# Grasshopper definition 04_fluids_archimedian_screw.gh (Grasshopper 1.0.7)
# plug-ins: FlexHopper

number_slider = Slider(60, range=10..200)
number_slider_2 = Slider(100, range=10..200)

# ----
# SIZE
number_slider_3 = Slider(10, range=5..200)

# ----
# Nr. of stacks
number_slider_4 = Slider(5, range=1..20)

custom_mesh_settings = SettingsCustom(
    StitchSeams=True,
    SimplePlanes=False,
    Refine=True,
    MinCount=Slider(9.401, range=0..10),
    MaxCount=Slider(2.638, range=0..10),
    AspectRatio=20,
    MaxDistance=Slider(10, range=0..10),
    MaxAngle=20,
    MinEdge=Slider(6.331, range=0..10),
    MaxEdge=0)
brep = Brep(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)
mesh = MeshBrep(Brep=brep, Settings=custom_mesh_settings)
tri = Triangulate(Mesh=mesh)  # -> Mesh, Count
weld = WeldMesh(Mesh=tri.Mesh, Angle=3.141592654)

custom_mesh_settings_2 = SettingsCustom(
    StitchSeams=True,
    SimplePlanes=False,
    Refine=True,
    MinCount=16,
    MaxCount=400,
    AspectRatio=Slider(1.989, range=0..10),
    MaxDistance=Slider(4.583, range=0..10),
    MaxAngle=20,
    MinEdge=Slider(5.063, range=0..10),
    MaxEdge=0)
brep_2 = Brep(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)
mesh_2 = MeshBrep(Brep=brep_2, Settings=custom_mesh_settings_2)
tri_2 = Triangulate(Mesh=mesh_2)  # -> Mesh, Count
weld_2 = WeldMesh(Mesh=tri_2.Mesh, Angle=3.141592654)

# ----
# Turning direction
timer = Timer(TimerInterval=10, Target=panel)  # disabled
panel = Panel("0.1")
rec = DataRecorder(panel, DataLimit=-10, RecordData=True)
ma = MassAddition(Input=flatten(rec))  # -> Result, PartialResults
line = Line(Line((0, 244.3785692, 155.132007), (0, 110.6479206, 50.35947809)))

dom = ConstructDomain(DomainStart=expr("x*-1", number_slider), DomainEnd=number_slider)
dom_2 = ConstructDomain(DomainStart=expr("x*-1", number_slider_2), DomainEnd=number_slider_2)
range = Range(Domain=dom, Steps=number_slider_3)
multiplication = Multiplication(A=ma.Result, B=Slider(1, range=-1..1))
item = ListItem(List=range, Index=0, Wrap=True)  # -> Item, Item1
subtraction = Subtraction(A=item.Item1, B=item.Item)
abs = Absolute(Value=subtraction)
rotax = RotateAxis(Geometry=weld_2, Angle=multiplication, Axis=line)  # -> Geometry, Transform
division = Division(A=number_slider_2, B=abs)
series = Series(Start=abs, Step=abs, Count=number_slider_4)
range_2 = Range(Domain=dom_2, Steps=expr("x*2", division))
Z = UnitZ(Factor=series)
pt = ConstructPoint(XCoordinate=graft(range), YCoordinate=range_2, ZCoordinate=0)  # -> flatten(Point)
move = Move(Geometry=pt, Motion=graft(Z))  # -> flatten(Geometry), Transform

# ----
# NumParticles
lng = ListLength(List=move.Geometry)
panel_2 = Panel(lng)

# ----
# Collision planes
panel_3 = Panel("""-1
0
1
0""")
panel_4 = Panel("""0
-1
0
1""")
multiplication_2 = Multiplication(A=number_slider_2, B=panel_4)
multiplication_3 = Multiplication(A=number_slider, B=panel_3)
pt_2 = ConstructPoint(XCoordinate=multiplication_3, YCoordinate=multiplication_2, ZCoordinate=0)
Y = UnitY(Factor=1)
X = UnitX(Factor=1)
Y_2 = UnitY(Factor=1)  # -> expr("x*-1", UnitVector)
X_2 = UnitX(Factor=1)  # -> expr("x*-1", UnitVector)
pt_3 = Point(pt_2)
merge = Merge(Data1=X, Data2=Y, Data3=X_2, Data4=Y_2)
pl = PlaneNormal(Origin=pt_3, ZAxis=merge)
xy = XYPlane(Origin=Point(0, 0, 0))
item_2 = ListItem(List=pl, Index=[0, 1, 2], Wrap=True)
collgeometry = FlexCollisionGeometry(CollisionPlanes=flatten([item_2, xy]), CollisionMeshes=flatten([weld, rotax.Geometry]))

# ----
# Particle Fountain
toggle = BooleanToggle(True)
particles = ParticlesFromPoints(Positions=move.Geometry, SelfCollision=toggle, IsFluid=toggle)

preview = CustomPreview(Geometry=rotax.Geometry, Material=ColourSwatch(SwatchColor=RGB(52, 57, 69)))
multiplication_4 = Multiplication(A=Slider(3.2287, range=0.0001..4), B=division)
parameters = FlexParametersFromValues(
    Gravity=Vector(0, 0, -9.81),
    Radius=multiplication_4,
    SolidRestDistance=0.15,
    FluidRestDistance=expr("x*0.5", multiplication_4),
    CollisionDistance=Slider(1.5, range=0..10),
    ParticleCollisionMargin=0.5,
    ShapeCollisionMargin=0.5,
    MaxSpeed=3.402823466e+38,
    MaxAcceleration=100,
    DynamicFriction=0,
    StaticFriction=0,
    ParticleFriction=0,
    Restitution=0,
    Adhesion=Slider(0, range=0..1),
    SleepThreshold=0,
    ShockPropagation=0,
    Dissipation=0,
    Damping=0,
    Fluid=True,
    Viscosity=0,
    Cohesion=Slider(1e-05, range=0..1),
    SurfaceTension=0,
    SolidPressure=1,
    FreeSurfaceDrag=0,
    Buoyancy=1,
    PlasticThreshold=0,
    PlasticCreep=0,
    Wind=Vector(0, 0, 0),
    Drag=0,
    Lift=0,
    RelaxationMode=True,
    RelaxationFactor=1)

opts = FlexSoverOptions(
    TimeStep=Slider(0.2, range=0..0.3),
    SubSteps=Slider(10, range=1..10),
    NumIterations=Slider(3, range=1..10),
    SceneMode=0,
    FixedNumberOfIteration=-1,
    MemoryRequirements=[131072, 96, 65536, 65536, 65536, 65536, 65536, 196608, 131972],
    StabilityScale=1)

scene = FlexScene(Particles=flatten(particles))
flex = FlexEngine(
    FlexParams=parameters,
    FlexCollisionGeometry=collgeometry,
    FlexScene=flatten(scene),
    FlexSolverOptions=opts,
    Reset=Button(),
    Go=Toggle(False))  # -> FlexObject, Information
panel_5 = Panel(flex.Information)
allparts = GetAllParticles(FlexObject=flex.FlexObject, N=1)  # -> Points, Vector
cloud = CloudDisplay(
    Points=allparts.Points,
    Colours=ColourSwatch(SwatchColor=RGB(174, 187, 207)),
    Size=expr("x/3", multiplication_4),
    SpriteType=0)
multiplication_5 = Multiplication(A=allparts.Vector, B=Slider(0.383, range=0..1))

vdisex = VectorDisplayEx(Point=allparts.Points, Vector=multiplication_5, Colour=RGB(0, 0, 0), Width=1)
