# Grasshopper definition 04_soft_shell.gh (Grasshopper 0.9.76)
# plug-ins: FlexHopper

number_slider = Slider(9, range=1..40)
srf = Surface(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)
sdivide = DivideSurface(Surface=srf, UCount=expr("x*4", number_slider), VCount=number_slider)  # -> Points, Normals, Parameters
flip = FlipMatrix(Data=sdivide.Points)
custom_mesh_settings = SettingsCustom(
    StitchSeams=True,
    SimplePlanes=False,
    Refine=True,
    MinCount=16,
    MaxCount=400,
    AspectRatio=20,
    MaxDistance=0,
    MaxAngle=20,
    MinEdge=5,
    MaxEdge=0)
shift = ShiftList(List=sdivide.Points, Shift=-1, Wrap=False)  # -> simplify(graft(List))
shift_2 = ShiftList(List=sdivide.Points, Shift=1, Wrap=False)  # -> simplify(graft(List))
shift_3 = ShiftList(List=flip, Shift=1, Wrap=False)
shift_4 = ShiftList(List=flip, Shift=-1, Wrap=False)
mesh = MeshBrep(Brep=srf, Settings=custom_mesh_settings)
flip_2 = FlipMatrix(Data=shift_3)  # -> simplify(Data)
flip_3 = FlipMatrix(Data=shift_4)  # -> simplify(graft(Data))
graft = GraftTree(Tree=flip_2, IncludeEmptyLists=True, IncludeNullItems=True)
shift_5 = ShiftList(List=flip_2, Shift=1, Wrap=False)  # -> simplify(graft(List))
merge = Merge(Data1=shift_2, Data2=shift, Data3=graft, Data4=shift_5)
quad = MeshQuad(CornerA=0, CornerB=1, CornerC=2, CornerD=3)
conmesh = ConstructMesh(Vertices=merge, Faces=quad)  # -> flatten(Mesh)
mjoin = MeshJoin(Meshes=conmesh)
tri = Triangulate(Mesh=mjoin)  # -> Mesh, Count
panel = Panel("""30
40
0.01
25
0.1
0.1""")
weld = WeldMesh(Mesh=tri.Mesh, Angle=3.141592654)
soft = SoftFromMesh(SoftBodyMesh=weld, Velocities=Vector(0, 0, 0), Mass=1, SoftParams=panel, GroupIndex=0)  # -> Particles, SpringIndices, ShapeMatchingConstraintIndices, SpringLines, ShapeMatchingConstraintBoundingBox, SoftBodies
pt = Point(soft.Particles)
crv = Curve(soft.SpringLines)
pdecon = Deconstruct(Point=pt)  # -> XComponent, YComponent, ZComponent
lng = ListLength(List=pt)
opts = FlexSolverOptions(TimeStep=0.01666666667, SubSteps=3, NumIterations=3)
smaller = SmallerThan(FirstNumber=pdecon.ZComponent, SecondNumber=Slider(1.554, range=-2..4))  # -> SmallerThan, OrEqualTo
series = Series(Start=0, Step=1, Count=lng)
dispatch = Dispatch(List=series, DispatchPattern=smaller.SmallerThan)  # -> ListA, ListB
anchor = ConstraintsAnchors(AnchorIndex=dispatch.ListA)
scene = FlexScene(SoftBodies=flatten(soft.SoftBodies), LocalConstraints=flatten(anchor))
flex = FlexEngine(FlexScene=flatten(scene), LockMode=False, Reset=Button(), Go=Toggle(False))  # -> FlexObject, Information
item = ListItem(List=pt, Index=dispatch.ListA, Wrap=True)
transform = GetRigidTranformations(FlexObject=flex.FlexObject)  # -> Translations, RotationVectors, RotationAngles, Transformations
msphereex = MeshSphereEx(Base=item, Radius=4, Count=3)
softs = GetSoftBodies(FlexObject=flex.FlexObject, Softs=soft.SoftBodies)  # -> Points, Velocity, SpringLines, ShapeMatchingBoxes, Mesh
mesh_2 = Mesh(softs.Mesh)
