# Grasshopper definition 05_spring_constraints.gh (Grasshopper 1.0.7)
# plug-ins: FlexHopper

numsprings = Slider(12, range=1..100)  # disabled
numsprings_2 = Slider(30, range=1..100)
series = Series(Start=0, Step=1, Count=expr("x+1", numsprings_2))
series_2 = Series(Start=0, Step=1, Count=expr("x+1", numsprings))  # disabled
shift = ShiftList(List=series, Shift=1, Wrap=False)

# ----
# Connect neighbors
# (controls elasticity)
shift_2 = ShiftList(List=series_2, Shift=1, Wrap=False)  # disabled
weave = Weave(Pattern=[0, 1], Stream0=series_2, Stream1=shift_2, NullGaps=False)  # disabled
split = SplitList(List=reverse(weave), Index=1)  # -> ListA, reverse(ListB); disabled
number_slider = Slider(0.95, range=0..0.99)  # disabled
springs = SpringConstraints(SpringPairIndices=flatten(split.ListB), SpringStiffness=number_slider)  # disabled

# ----
# Connect next but one neighbors
# (controls bending / crumbling)
shift_3 = ShiftList(List=series_2, Shift=2, Wrap=False)  # disabled
weave_2 = Weave(Pattern=[0, 1], Stream0=series_2, Stream1=shift_3, NullGaps=False)  # disabled
number_slider_2 = Slider(0.99, range=0..0.99)  # disabled
springs_2 = SpringConstraints(SpringPairIndices=flatten(weave_2), SpringStiffness=number_slider_2)  # disabled

range = Range(Domain=Domain(0, 20), Steps=numsprings)  # disabled
weave_3 = Weave(Pattern=[0, 1], Stream0=series, Stream1=shift, NullGaps=False)
split_2 = SplitList(List=reverse(weave_3), Index=1)  # -> ListA, reverse(ListB)
pt = ConstructPoint(XCoordinate=range, YCoordinate=0, ZCoordinate=50)  # disabled
toggle = BooleanToggle(False)  # disabled
panel = Panel("0")  # disabled
panel_2 = Panel(split_2.ListB)
range_2 = Range(Domain=Domain(0, 20), Steps=numsprings_2)
toggle_2 = BooleanToggle(False)
particles = ParticlesFromPoints(Positions=pt, SelfCollision=toggle, IsFluid=toggle)  # disabled
anchor = Anchor(AnchorIndex=panel)  # disabled

# ----
# Connect us!
springs_3 = ConstraintsSprings(SpringPairIndices=panel_2, TargetSpringLength=Slider(0.427, range=-2..1), SpringStiffness=Slider(0.95, range=0..2))
anchor_2 = ConstraintsAnchors(AnchorIndex="0")

pt_2 = ConstructPoint(XCoordinate=range_2, YCoordinate=0, ZCoordinate=50)
particles_2 = ParticlesFromPoints(Positions=pt_2, SelfCollision=toggle_2, IsFluid=toggle_2)
scene = FlexScene(Particles=flatten(particles_2))
opts = FlexSolverOptions(
    TimeStep=Slider(0.1, range=0..0.1),
    SubSteps=Slider(2, range=1..10),
    NumIterations=Slider(10, range=1..10),
    SceneMode=0,
    FixedNumberOfIteration=-1,
    MemoryRequirements=[131072, 96, 65536, 65536, 65536, 65536, 65536, 196608, 131972],
    StabilityScale=1)
scene_2 = FlexScene(Particles=flatten(particles), LocalConstraints=flatten([springs, springs_2, anchor]))  # disabled
flex = FlexEngine(FlexScene=flatten(scene), FlexSolverOptions=opts, Reset=Button(), Go=Toggle(False))  # -> FlexObject, Information
allsprings = GetAllSprings(FlexObject=flex.FlexObject, N=1)
allparts = GetAllParticles(FlexObject=flex.FlexObject, N=1)  # -> Points, Vector
toggle_3 = BooleanToggle(False)  # disabled
button = Button()  # disabled
flex_2 = FlexEngine(FlexScene=flatten(scene_2), Reset=button, Go=toggle_3)  # -> FlexObject, Information; disabled
allparts_2 = GetAllParticles(FlexObject=flex_2.FlexObject, N=1)  # -> Points, Vector; disabled
allsprings_2 = GetAllSprings(FlexObject=flex_2.FlexObject, N=1)  # disabled
