# Grasshopper definition 06_inflatablessoft_bunny.gh (Grasshopper 0.9.76)
# plug-ins: FlexHopper

mesh = Mesh(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)

# ----
# Many bunnies
number_slider = Slider(10, range=1..100)
random = Random(Range=Domain(5, 60), Number=expr("x*3", number_slider), Seed=346)
random_2 = Random(Range=Domain(-1, 1), Number=expr("x*3", number_slider), Seed=3)
partition = PartitionList(List=random, Size=3)
partition_2 = PartitionList(List=random_2, Size=3)
item = ListItem(List=partition, Index=0, Wrap=True)  # -> Item, Item1, Item2
item_2 = ListItem(List=partition_2, Index=0, Wrap=True)  # -> Item, Item1, Item2
vec = VectorXYZ(XComponent=item_2.Item, YComponent=item_2.Item1, ZComponent=item_2.Item2)  # -> Vector, Length
pt = ConstructPoint(XCoordinate=item.Item, YCoordinate=item.Item1, ZCoordinate=item.Item2)
pl = PlaneNormal(Origin=pt, ZAxis=vec.Vector)
orient = Orient(Geometry=mesh, Source=PlaneXY(0, 0, 0), Target=pl)  # -> flatten(Geometry), Transform

# ----
# One bunny
vec_2 = VectorXYZ(XComponent=0, YComponent=0, ZComponent=15)  # -> Vector, Length
move = Move(Geometry=mesh, Motion=vec_2.Vector)  # -> Geometry, Transform

msphereex = MeshSphereEx(Base=vec_2.Vector, Radius=10, Count=5)
tri = Triangulate(Mesh=msphereex)  # -> Mesh, Count
weld = WeldMesh(Mesh=tri.Mesh, Angle=3.141592654)
demesh = DeconstructMesh(Mesh=weld)  # -> Vertices, Faces, Colours, Normals
deface = DeconstructFace(Face=demesh.Faces)  # -> CornerA, CornerB, CornerC, CornerD
triangle = MeshTriangle(CornerA=deface.CornerA, CornerB=deface.CornerC, CornerC=deface.CornerB)
conmesh = ConstructMesh(Vertices=demesh.Vertices, Faces=triangle)
parameters = FlexParametersFromValues(
    Gravity=Vector(0, 0, -9.81),
    Radius=0.15,
    SolidRestDistance=0.075,
    FluidRestDistance=0.1,
    CollisionDistance=0.075,
    ParticleCollisionMargin=0.5,
    ShapeCollisionMargin=0.5,
    MaxSpeed=3.402823466e+38,
    MaxAcceleration=1000,
    DynamicFriction=Slider(0.05, range=0..1),
    StaticFriction=Slider(0.05, range=0..1),
    ParticleFriction=0,
    Restitution=0,
    Adhesion=0,
    SleepThreshold=0,
    ShockPropagation=0,
    Dissipation=0,
    Damping=Slider(0.2, range=0..1),
    Fluid=True,
    Viscosity=0,
    Cohesion=0.025,
    SurfaceTension=0,
    SolidPressure=1,
    FreeSurfaceDrag=0,
    Buoyancy=1,
    PlasticThreshold=0,
    PlasticCreep=0,
    Wind=Vector(0, 0, 0),
    Drag=Slider(0.25, range=0..1),
    Lift=Slider(0.25, range=0..1),
    RelaxationMode=True,
    RelaxationFactor=1)
volume = Volume(Geometry=weld)  # -> Volume, Centroid
filter = StreamFilter(Gate=Toggle(False), Stream0=move.Geometry, Stream1=orient.Geometry)
cloth = ClothFromMesh(
    ClothMeshes=weld,
    StretchStiffness=Slider(0.2, range=0..1),
    BendingStiffness=Slider(0, range=0..1),
    PreTension=1,
    GroupIndex="0")
panel = Panel("""1
2
0
1.5
2
0.1
1.5
0.0
0.0""")
panel_2 = Panel("""0.6
2
0
0.7
1.2
0.2
1
0.0
0.0""")
inflatable = InflatableFromCloth(
    Cloths=cloth,
    RestVolume=Slider(-0.44, range=-1..1),
    OverPressure=Slider(0.45, range=0..2),
    ContraintScale=Slider(1.192, range=0..2),
    GroupIndex="1")
soft = SoftFromMesh(SoftBodyMesh=flatten(filter), Velocities=Vector(0, 0, 0), Mass=1, SoftParams=panel, GroupIndex=0)  # -> Particles, SpringIndices, simplify(ShapeMatchingConstraintIndices), SpringLines, ShapeMatchingConstraintBoundingBox, SoftBodies; disabled
xy = XYPlane(Origin=Point(0, 0, 0))
scene = FlexScene(Inflatables=flatten(inflatable))
collgeometry = FlexCollisionGeometry(CollisionPlanes=flatten(xy))
scene_2 = FlexScene(SoftBodies=flatten(soft.SoftBodies))
opts = FlexSolverOptions(TimeStep=Slider(0.01666667, range=0..0.1), SubSteps=Slider(6, range=1..15), NumIterations=Slider(15, range=1..15))
panel_3 = Panel(scene_2)
flex = FlexEngine(
    FlexParams=parameters,
    FlexCollisionGeometry=collgeometry,
    FlexScene=flatten(scene),
    FlexSolverOptions=opts,
    LockMode=False,
    Reset=Button(),
    Go=Toggle(True))  # -> FlexObject, Information
allparts = GetAllParticles(FlexObject=flex.FlexObject, N=1)  # -> Points, Vector
inflatables = GetInflatables(FlexObject=flex.FlexObject, N=0, Inflatable=inflatable)  # -> Points, Vector, Meshes
softs = GetSoftBodies(FlexObject=flex.FlexObject, Softs=soft.SoftBodies)  # -> Points, Velocity, SpringLines, ShapeMatchingBoxes, Mesh
material = CreateMaterial(
    Diffuse=ColourSwatch(SwatchColor=RGB(80, 98, 143)),
    Specular=ColourSwatch(SwatchColor=RGB(29, 31, 36)),
    Emission=ColourSwatch(SwatchColor=RGB(80, 98, 143)),
    Transparency=Slider(0.8, range=0..1),
    Shine=Slider(1, range=0..100))
swatch = ColourSwatch(SwatchColor=RGB(0, 17, 255))
preview = CustomPreview(Geometry=softs.SpringLines, Material=swatch)  # disabled
preview_2 = CustomPreview(Geometry=softs.ShapeMatchingBoxes, Material=material)
preview_3 = CustomPreview(Geometry=soft.SpringLines, Material=swatch)
preview_4 = CustomPreview(Geometry=soft.ShapeMatchingConstraintBoundingBox, Material=material)
