# Grasshopper definition 06_spring_constraints_collision.gh (Grasshopper 1.0.7)
# plug-ins: FlexHopper

panel = Panel("""-20
0
20""")
panel_2 = Panel("""0
0
0""")
panel_3 = Panel("""50
40
50""")
pt = ConstructPoint(XCoordinate=panel, YCoordinate=panel_2, ZCoordinate=panel_3)
panel_4 = Panel("""-20
0
20""")  # disabled
panel_5 = Panel("""5
5
5""")  # disabled
panel_6 = Panel("""50
40
50""")  # disabled
panel_7 = Panel("""5
5
5""")  # disabled
panel_8 = Panel("""-20
0
20""")  # disabled
panel_9 = Panel("""35
45
35""")  # disabled
intcrv = Interpolate(Vertices=pt, Degree=3, Periodic=False, KnotStyle=1)  # -> Curve, Length, Domain
pt_2 = ConstructPoint(XCoordinate=panel_4, YCoordinate=panel_5, ZCoordinate=panel_6)  # disabled
pt_3 = ConstructPoint(XCoordinate=panel_8, YCoordinate=panel_7, ZCoordinate=panel_9)  # disabled
intcrv_2 = Interpolate(Vertices=pt_2, Degree=3, Periodic=False, KnotStyle=1)  # -> Curve, Length, Domain; disabled
intcrv_3 = Interpolate(Vertices=pt_3, Degree=3, Periodic=False, KnotStyle=1)  # -> Curve, Length, Domain; disabled
rotate = Rotate(Geometry=intcrv_2.Curve, Angle=[0, 3.141592654], Plane=PlaneXY(0, 0, 0))  # -> Geometry, Transform; disabled
rotate_2 = Rotate(Geometry=intcrv_3.Curve, Angle=[1.570796327, 4.71238898], Plane=PlaneXY(0, 0, 0))  # -> Geometry, Transform; disabled
rotate_3 = Rotate(Geometry=intcrv.Curve, Angle=1.570796327, Plane=PlaneXY(0, 0, 0))  # -> Geometry, Transform
crv = Curve([rotate.Geometry, rotate_2.Geometry])  # disabled
Z = UnitZ(Factor=-10)
number_slider = Slider(100, range=1..200)
number_slider_2 = Slider(200, range=1..200)  # disabled
move = Move(Geometry=rotate_3.Geometry, Motion=Z)  # -> Geometry, Transform
panel_10 = Panel("0")  # disabled
divide = DivideCurve(Curve=intcrv.Curve, Count=number_slider, Kinks=False)  # -> Points, Tangents, Parameters
divide_2 = DivideCurve(Curve=move.Geometry, Count=number_slider, Kinks=False)  # -> Points, Tangents, Parameters
divide_3 = DivideCurve(Curve=crv, Count=number_slider_2, Kinks=False)  # -> Points, Tangents, Parameters; disabled
pline = PolyLine(Vertices=divide_2.Points, Closed=False)
pline_2 = PolyLine(Vertices=divide.Points, Closed=False)
number_slider_3 = Slider(-0.1, range=-1..0)  # disabled
entwine = Entwine(
    Branch00=[panel_10, number_slider_2],
    Branch01=[panel_10, number_slider_2],
    Branch02=[panel_10, number_slider_2],
    Branch03=[panel_10, number_slider_2],
    FlattenInputs=True)  # disabled
number_slider_4 = Slider(-0.1, range=-1..0)  # disabled
number_slider_5 = Slider(-0.1, range=-1..0)  # disabled
number_slider_6 = Slider(-0.1, range=-1..0)  # disabled
number_slider_7 = Slider(1, range=0..1)  # disabled
pline_3 = PolyLine(Vertices=divide_3.Points, Closed=False)  # disabled
entwine_2 = Entwine(Branch00="0", Branch01=["0", number_slider], FlattenInputs=True)
panel_11 = Panel("""0
1""")
toggle = BooleanToggle(False)  # disabled
panel_12 = Panel("""0
1
2
3""")  # disabled
number_slider_8 = Slider(0.5, range=0..5)
int = Integer(entwine_2)
int_2 = Integer(entwine)  # disabled
number_slider_9 = Slider(0.5, range=0..5)  # disabled
opts = FlexSolverOptions(
    TimeStep=Slider(0.03, range=0..1),
    SubSteps=10,
    NumIterations=10,
    SceneMode=0,
    FixedNumberOfIteration=-1,
    MemoryRequirements=[131072, 96, 65536, 65536, 65536, 65536, 65536, 196608, 131972],
    StabilityScale=1)
opts_2 = FlexSolverOptions(
    TimeStep=0.01666666667,
    SubSteps=10,
    NumIterations=10,
    SceneMode=0,
    FixedNumberOfIteration=-1,
    MemoryRequirements=[131072, 96, 65536, 65536, 65536, 65536, 65536, 196608, 131972],
    StabilityScale=1)  # disabled
springs = SpringSystemFromLinesMeshes(
    Springs=graft([pline_2, pline]),
    SpringStiffness=Slider(1, range=0..1),
    SelfCollision=Toggle(False),
    Anchors=int,
    GroupIndex=panel_11)
springs_2 = SpringSystemFromLinesMeshes(
    Springs=graft(pline_3),
    TargetSpringLength=graft([number_slider_3, number_slider_4, number_slider_5, number_slider_6]),
    SpringStiffness=number_slider_7,
    SelfCollision=toggle,
    Anchors=int_2,
    GroupIndex=panel_12)  # disabled
scene = FlexScene(SpringSystems=flatten(springs))
button = Button()  # disabled
toggle_2 = BooleanToggle(False)  # disabled
scene_2 = FlexScene(SpringSystems=flatten(springs_2))  # disabled
parameters = FlexParametersFromValues(
    Gravity=Vector(0, 0, -9.81),
    Radius=number_slider_8,
    SolidRestDistance=number_slider_8,
    FluidRestDistance=0.1,
    CollisionDistance=0.075,
    ParticleCollisionMargin=0.5,
    ShapeCollisionMargin=0.5,
    MaxSpeed=3.402823466e+38,
    MaxAcceleration=100,
    DynamicFriction=0,
    StaticFriction=0,
    ParticleFriction=0,
    Restitution=0,
    Adhesion=0,
    SleepThreshold=0,
    ShockPropagation=0,
    Dissipation=0,
    Damping=0,
    Fluid=True,
    Viscosity=0,
    Cohesion=0.025,
    SurfaceTension=0,
    SolidPressure=1,
    FreeSurfaceDrag=0,
    Buoyancy=1,
    PlasticThreshold=0,
    PlasticCreep=0,
    Wind=Vector(0, 0, 0),
    Drag=0,
    Lift=0,
    RelaxationMode=True,
    RelaxationFactor=1)
flex = FlexEngine(FlexParams=parameters, FlexScene=flatten(scene), FlexSolverOptions=opts, Reset=Button(), Go=Toggle(False))  # -> FlexObject, Information
parameters_2 = FlexParametersFromValues(
    Gravity=Vector(0, 0, -9.81),
    Radius=number_slider_9,
    SolidRestDistance=number_slider_9,
    FluidRestDistance=0.1,
    CollisionDistance=0.075,
    ParticleCollisionMargin=0.5,
    ShapeCollisionMargin=0.5,
    MaxSpeed=3.402823466e+38,
    MaxAcceleration=100,
    DynamicFriction=0,
    StaticFriction=0,
    ParticleFriction=0,
    Restitution=0,
    Adhesion=0,
    SleepThreshold=0,
    ShockPropagation=0,
    Dissipation=0,
    Damping=0,
    Fluid=True,
    Viscosity=0,
    Cohesion=0.025,
    SurfaceTension=0,
    SolidPressure=1,
    FreeSurfaceDrag=0,
    Buoyancy=1,
    PlasticThreshold=0,
    PlasticCreep=0,
    Wind=Vector(0, 0, 0),
    Drag=0,
    Lift=0,
    RelaxationMode=True,
    RelaxationFactor=1)  # disabled
flex_2 = FlexEngine(FlexParams=parameters_2, FlexScene=flatten(scene_2), FlexSolverOptions=opts_2, Reset=button, Go=toggle_2)  # -> FlexObject, Information; disabled
allsprings = GetAllSprings(FlexObject=flex.FlexObject, N=1)
allparts = GetAllParticles(FlexObject=flex.FlexObject, N=1)  # -> Points, Vector
allsprings_2 = GetAllSprings(FlexObject=flex_2.FlexObject, N=1)  # disabled
allparts_2 = GetAllParticles(FlexObject=flex_2.FlexObject, N=1)  # -> Points, Vector; disabled
msphereex = MeshSphereEx(Base=allparts.Points, Radius=expr("x*0.5", number_slider_8), Count=5)
msphereex_2 = MeshSphereEx(Base=allparts_2.Points, Radius=expr("x*0.5", number_slider_9), Count=5)  # disabled
