# Grasshopper definition 07_big_mesh.gh (Grasshopper 1.0.5)
# plug-ins: FlexHopper

number_slider = Slider(44.233, range=0..50)
number_slider_2 = Slider(55.0945, range=0.0001..70)
pt = ConstructPoint(XCoordinate=expr("x*-1", number_slider_2), YCoordinate=0, ZCoordinate=number_slider)
pt_2 = ConstructPoint(XCoordinate=number_slider_2, YCoordinate=0, ZCoordinate=number_slider)
yz = YZPlane(Origin=[pt_2, pt])
ellipse = Ellipse(
    Plane=yz,
    Radius1=[Slider(43.23, range=0..50), Slider(22.38, range=0..50)],
    Radius2=[Slider(43.28, range=0..50), Slider(24.66, range=0..50)])  # -> Ellipse, Focus1, Focus2
pipe = Pipe(Curve=ellipse.Ellipse, Radius=0.5, Caps=0)  # -> flatten(Pipe)
loft = Loft(Curves=ellipse.Ellipse, Options={Adjust=False, Closed=False, LoftEnds=0, LoftSimp=0, LoftType=0, Rebuild=10, Refit=0.01})
preview = CustomPreview(Geometry=pipe, Shader=ColourSwatch(SwatchColor=RGB(161, 161, 161)))
number_slider_3 = Slider(50, range=1..100)
mesh_uv = MeshSurface(Surface=loft, UCount=number_slider_3, VCount=number_slider_3, Overhang=True, Equalize=False)
tri = Triangulate(Mesh=mesh_uv)  # -> Mesh, Count
weld = WeldMesh(Mesh=tri.Mesh, Angle=3.141592654)
demesh = DeconstructMesh(Mesh=weld)  # -> Vertices, Faces, Colours, Normals
item = ListItem(List=ellipse.Ellipse, Index=0, Wrap=True)  # -> Item, Item1
crv_cp = CurveClosestPoint(Point=demesh.Vertices, Curve=graft([item.Item1, item.Item]))  # -> Point, Parameter, Distance
lng = ListLength(List=demesh.Vertices)
smaller = SmallerThan(FirstNumber=crv_cp.Distance, SecondNumber=Slider(0.001, range=0..1))  # -> SmallerThan, OrEqualTo
series = Series(Start=0, Step=1, Count=lng)
int = Integer(series)
dispatch = Dispatch(List=int, DispatchPattern=smaller.SmallerThan)  # -> flatten(ListA), ListB
item_2 = ListItem(List=demesh.Vertices, Index=Slider(3844, range=0..4000), Wrap=True)
cp = ClosestPoint(Point=item_2, Cloud=demesh.Vertices)  # -> ClosestPoint, CPIndex, Distance
pt_3 = ConstructPoint(XCoordinate=0, YCoordinate=0, ZCoordinate=0)
reset = Button()
go = BooleanToggle(False)
int_2 = Integer("0")
springs = SpringSystemFromLinesMeshes(
    Springs=weld,
    TargetSpringLength=Slider(-0.043, range=-2..1),
    SpringStiffness=Slider(0.474, range=-2..1),
    AdditionalSheetStiffening=Toggle(True),
    SelfCollision=Toggle(False),
    Anchors=flatten([dispatch.ListA, cp.ClosestPoint, pt_3]),
    GroupIndex=3)
parameters = FlexParametersFromValues(
    Gravity=Vector(0, 0, -9.81),
    Radius=0.15,
    SolidRestDistance=0.15,
    FluidRestDistance=0.1,
    CollisionDistance=0.075,
    ParticleCollisionMargin=0.5,
    ShapeCollisionMargin=0.5,
    MaxSpeed=3.402823466e+38,
    MaxAcceleration=100,
    DynamicFriction=0,
    StaticFriction=0,
    ParticleFriction=Slider(10, range=0..10),
    Restitution=0,
    Adhesion=0,
    SleepThreshold=Slider(1, range=0..1),
    ShockPropagation=0,
    Dissipation=0,
    Damping=Slider(1, range=0..1),
    Fluid=True,
    Viscosity=0,
    Cohesion=0.025,
    SurfaceTension=0,
    SolidPressure=1,
    FreeSurfaceDrag=0,
    Buoyancy=1,
    PlasticThreshold=0,
    PlasticCreep=0,
    Wind=Vector(0, 0, 0),
    Drag=0,
    Lift=0,
    RelaxationMode=True,
    RelaxationFactor=1)
scene = FlexScene(SpringSystems=flatten(springs))
opts = FlexSolverOptions(
    TimeStep=0.02,
    SubSteps=Slider(10, range=2..50),
    NumIterations=Slider(30, range=2..50),
    SceneMode=Slider(0, range=0..2),
    FixedNumberOfIteration=-1)
flex = FlexEngine(FlexParams=parameters, FlexScene=flatten(scene), FlexSolverOptions=opts, Reset=reset, Go=go)  # -> FlexObject, Information
allsprings = GetAllSprings(FlexObject=flex.FlexObject, N=1)
preview_2 = CustomPreview(Geometry=allsprings, Shader=ColourSwatch(SwatchColor=RGB(255, 255, 255)))
