# Grasshopper definition 07_fiber_winding.gh (Grasshopper 1.0.7)
# plug-ins: FlexHopper

number_slider = Slider(20, range=0..50)
number_slider_2 = Slider(40, range=0.0001..70)
pt = ConstructPoint(XCoordinate=expr("x*-1", number_slider_2), YCoordinate=0, ZCoordinate=number_slider)
pt_2 = ConstructPoint(XCoordinate=number_slider_2, YCoordinate=0, ZCoordinate=number_slider)
yz = YZPlane(Origin=[pt_2, pt])

# ----
# Controls
number_slider_3 = Slider(11, range=-15..15)
adjust_string = BooleanToggle(False)
reset = Button()
knob = ControlKnob(Decimals=0, Limit=True, Maximum=250, Minimum=0, Range=25, Value=23)
go = BooleanToggle(False)

fiber_resolution = Slider(100, range=1..200)
number_slider_4 = Slider(25, range=0..50)
addition = Addition(A=knob, B=number_slider_3)
equals = Equality(FirstNumber=knob, SecondNumber=knob)  # -> Equality, Inequality
avr = Average(Input=[pt_2, pt])
ellipse = Ellipse(
    Plane=yz,
    Radius1=[Slider(25, range=0..50), Slider(15, range=0..50)],
    Radius2=[Slider(15, range=0..50), Slider(25, range=0..50)])  # -> Ellipse, Focus1, Focus2
and = GateAnd(A=equals.Equality, B=adjust_string)
rec = DataRecorder(and, DataLimit=-10, RecordData=True)
bool = Boolean(invert(rec))
int = Integer(bool)
mod = Modulus(A=[knob, addition], B=number_slider_4)
divide = DivideCurve(Curve=ellipse.Ellipse, Count=number_slider_4, Kinks=False)  # -> Points, Tangents, Parameters
ma = MassAddition(Input=int)  # -> Result, PartialResults
pipe = Pipe(Curve=ellipse.Ellipse, Radius=0.5, Caps=0)  # -> flatten(Pipe)
panel = Panel(ma.Result)
item = ListItem(List=divide.Points, Index=graft(mod), Wrap=True)  # -> flatten(Item)
preview = CustomPreview(Geometry=pipe, Shader=ColourSwatch(SwatchColor=RGB(161, 161, 161)))
item_2 = ListItem(List=item, Index=0, Wrap=True)  # -> Item, Item1
sph = Sphere(Base=[item_2.Item, item_2.Item1], Radius=1.5)
avr_2 = Average(Input=[item_2.Item, item_2.Item1])
vec2pt = Vector2Pt(PointA=avr, PointB=avr_2, Unitize=True)  # -> Vector, Length
multiplication = Multiplication(A=vec2pt.Vector, B=Slider(1, range=-1..1))
multiplication_2 = Multiplication(A=multiplication, B=Slider(29.9, range=0..50))
move = Move(Geometry=avr_2, Motion=multiplication_2)  # -> Geometry, Transform
merge = Merge(Data1=item_2.Item, Data2=move.Geometry, Data3=item_2.Item1)
intcrv = Interpolate(Vertices=merge, Degree=3, Periodic=False, KnotStyle=1)  # -> Curve, Length, Domain
divide_2 = DivideCurve(Curve=intcrv.Curve, Count=fiber_resolution, Kinks=False)  # -> Points, Tangents, Parameters
shift = ShiftList(List=divide_2.Points, Shift=1, Wrap=False)
shift_2 = ShiftList(List=divide_2.Points, Shift=-1, Wrap=False)
dist = Distance(PointA=shift_2, PointB=shift)
int_2 = Integer(["0", fiber_resolution])
pline = PolyLine(Vertices=divide_2.Points, Closed=False)
avr_3 = Average(Input=dist)
springs = SpringSystemFromLinesMeshes(
    Springs=pline,
    TargetSpringLength=Slider(0, range=-2..2),
    SpringStiffness=Slider(0.95, range=0..1),
    SelfCollision=Toggle(False),
    Anchors=int_2,
    GroupIndex=panel)
panel_2 = Panel(avr_3)
gate = StreamGate(Stream=springs, Gate=adjust_string)  # -> Target0, Target1
parameters = FlexParametersFromValues(
    Gravity=Vector(0, 0, -9.81),
    Radius=panel_2,
    SolidRestDistance=panel_2,
    FluidRestDistance=0.1,
    CollisionDistance=0.075,
    ParticleCollisionMargin=0.5,
    ShapeCollisionMargin=0.5,
    MaxSpeed=3.402823466e+38,
    MaxAcceleration=100,
    DynamicFriction=0,
    StaticFriction=0,
    ParticleFriction=Slider(10, range=0..10),
    Restitution=0,
    Adhesion=0,
    SleepThreshold=Slider(1, range=0..1),
    ShockPropagation=0,
    Dissipation=0,
    Damping=Slider(1, range=0..1),
    Fluid=True,
    Viscosity=0,
    Cohesion=0.025,
    SurfaceTension=0,
    SolidPressure=1,
    FreeSurfaceDrag=0,
    Buoyancy=1,
    PlasticThreshold=0,
    PlasticCreep=0,
    Wind=Vector(0, 0, 0),
    Drag=0,
    Lift=0,
    RelaxationMode=True,
    RelaxationFactor=1)
opts = FlexSolverOptions(
    TimeStep=0.02,
    SubSteps=Slider(8, range=2..50),
    NumIterations=Slider(10, range=2..50),
    SceneMode=Slider(1, range=0..2),
    FixedNumberOfIteration=-1,
    MemoryRequirements=[131072, 96, 65536, 65536, 65536, 65536, 65536, 196608, 131972],
    StabilityScale=1)
scene = FlexScene(SpringSystems=flatten(gate.Target0))
flex = FlexEngine(FlexParams=parameters, FlexScene=flatten(scene), FlexSolverOptions=opts, Reset=reset, Go=go)  # -> FlexObject, Information
allparts = GetAllParticles(FlexObject=flex.FlexObject, N=1)  # -> Points, Vector
allsprings = GetAllSprings(FlexObject=flex.FlexObject, N=1)
msphereex = MeshSphereEx(Base=allparts.Points, Radius=expr("x*0.5", panel_2), Count=3)
preview_2 = CustomPreview(Geometry=allsprings, Shader=ColourSwatch(SwatchColor=RGB(255, 255, 255)))
