# Grasshopper definition 10_rigid_spheres.gh (Grasshopper 1.0.7)
# plug-ins: FlexHopper

number_slider = Slider(9.42, range=0..100)
Z = UnitZ(Factor=Slider(26.3, range=1..100))
msphereex = MeshSphereEx(Base=PlaneXY(0, 0, 0), Radius=10, Count=Slider(6, range=1..20))
move = Move(Geometry=msphereex, Motion=Z)  # -> Geometry, Transform
Y = UnitY(Factor=Slider(25.1, range=1..100))
move_2 = Move(Geometry=move.Geometry, Motion=Y)  # -> Geometry, Transform
box = CenterBox(Base=PlaneXY(0, 0, 0), X=number_slider, Y=number_slider, Z=number_slider)
demesh = DeconstructMesh(Mesh=flatten([move.Geometry, move_2.Geometry]))  # -> flatten(Vertices), Faces, Colours, Normals
number_slider_2 = Slider(10, range=1..20)
lng = ListLength(List=demesh.Vertices)
series = Series(Start=0, Step=1, Count=lng)
opts = FlexSolverOptions(
    TimeStep=Slider(0.0648, range=0..0.2),
    SubSteps=number_slider_2,
    NumIterations=number_slider_2,
    SceneMode=0,
    FixedNumberOfIteration=-1,
    MemoryRequirements=[131072, 96, 65536, 65536, 65536, 65536, 65536, 196608, 131972],
    StabilityScale=1)
rigid = RigidFromMesh(RigidBodyMesh=[move.Geometry, move_2.Geometry], Velocities=Vector(0, 0, 0), Mass=1, Stiffness=0.95, GroupIndex=0)
particles = ParticlesFromPoints(Points=demesh.Vertices)
partition = PartitionList(List=series, Size=294)  # -> simplify(Chunks)
shape_matching = ConstraintShapeMatchingConstraint(ParticleIndices=partition, Stiffness=Slider(0.715, range=0..1))
xy = XYPlane(Origin=Point(0, 0, 0))
scene = FlexScene(RigidBodies=flatten(rigid))
collgeometry = FlexCollisionGeometry(CollisionPlanes=flatten(xy), CollisionBoxes=flatten(box))
scene_2 = FlexScene(Particles=flatten(particles), LocalConstraints=flatten(shape_matching))
flex = FlexEngine(FlexCollisionGeometry=collgeometry, FlexScene=flatten(scene), FlexSolverOptions=opts, Reset=Button(), Go=Toggle(False))  # -> FlexObject, Information
rigids = GetRigids(FlexObject=flex.FlexObject, N=0, Deformable=True, Rigids=rigid)  # -> Points, Vector, Meshes
allparts = GetAllParticles(FlexObject=flex.FlexObject, N=1)  # -> Points, Vector
