# Grasshopper definition 11_rigid_aggregates.gh (Grasshopper 1.0.7)
# plug-ins: FlexHopper

number_slider = Slider(10, range=0..20)  # disabled
X = UnitX(Factor=1)  # disabled
Y = UnitY(Factor=1)  # disabled
Z = UnitZ(Factor=1)  # disabled
merge = Merge(Data1=X, Data2=Y, Data3=Z)  # disabled
merge_2 = Merge(Data1=X, Data2=Y, Data3=Z)  # disabled
xy = XYPlane(Origin=Point(0, 0, 0))  # disabled
multiplication = Multiplication(A=merge, B=-1)  # disabled
line = LineSDL(Start=xy, Direction=[merge_2, multiplication], Length=number_slider)  # disabled

number_slider_2 = Slider(30, range=0..100)  # disabled
number_slider_3 = Slider(2.4, range=1..10)  # disabled

number_slider_4 = Slider(10, range=0..20)  # disabled
panel = Panel("""sqrt(8/9)
-sqrt(2/9)
-sqrt(2/9)
0""")  # disabled
panel_2 = Panel("""0
sqrt(2/3)
-sqrt(2/3)
0""")  # disabled
panel_3 = Panel("""-1/3
-1/3
-1/3
1""")  # disabled
number_slider_5 = Slider(0.4, range=0..5)  # disabled
number_slider_6 = Slider(0.72, range=0..5)  # disabled
number_slider_7 = Slider(5, range=0..5)  # disabled
number_slider_8 = Slider(3.31, range=0..5)  # disabled
vec = VectorXYZ(XComponent=panel, YComponent=panel_2, ZComponent=panel_3)  # -> Vector, Length; disabled
xy_2 = XYPlane(Origin=Point(0, 0, 0))  # disabled
pl = PlaneNormal(Origin=Point(0, 0, 0), ZAxis=vec.Vector)  # disabled
line_2 = LineSDL(Start=xy_2, Direction=vec.Vector, Length=number_slider_4)  # disabled
custom_mesh_settings = SettingsCustom(
    StitchSeams=True,
    SimplePlanes=False,
    Refine=True,
    MinCount=16,
    MaxCount=400,
    AspectRatio=number_slider_8,
    MaxDistance=number_slider_7,
    MaxAngle=20,
    MinEdge=number_slider_5,
    MaxEdge=number_slider_6)  # disabled
cone = Cone(Base=pl, Radius=0.5, Length=number_slider_4)  # -> Cone, Tip; disabled
mesh = MeshBrep(Brep=cone.Cone, Settings=custom_mesh_settings)  # disabled
weld = WeldMesh(Mesh=mesh, Angle=3.141592654)  # disabled

number_slider_9 = Slider(2.4, range=1..10)

number_slider_10 = Slider(10, range=0..20)
X_2 = UnitX(Factor=1)
Y_2 = UnitY(Factor=1)
Z_2 = UnitZ(Factor=1)
merge_3 = Merge(Data1=X_2, Data2=Y_2, Data3=Z_2)
merge_4 = Merge(Data1=X_2, Data2=Y_2, Data3=Z_2)
xy_3 = XYPlane(Origin=Point(0, 0, 0))
multiplication_2 = Multiplication(A=merge_3, B=-1)
line_3 = LineSDL(Start=xy_3, Direction=[merge_4, multiplication_2], Length=number_slider_10)

number_slider_11 = Slider(6, range=2..20)  # disabled
divide = DivideCurve(Curve=line, Count=number_slider_11, Kinks=False)  # -> Points, Tangents, Parameters; disabled
num = Number(Slider(0.2, range=0.001..1))
num_2 = Number(number_slider_10)
item = ListItem(List=flatten(divide.Points), Index=0, Wrap=True)  # -> Item, Item1; disabled
split = SplitList(List=divide.Points, Index=1)  # -> ListA, ListB; disabled
merge_5 = Merge(Data1=num_2, Data2=num, Data3=num)
merge_6 = Merge(Data1=num, Data2=num_2, Data3=num)
merge_7 = Merge(Data1=num, Data2=num, Data3=num_2)
pt = Point(flatten(split.ListB))  # disabled
dist = Distance(PointA=item.Item, PointB=item.Item1)  # disabled
number_slider_12 = Slider(0.2, range=0.001..1)  # disabled
divide_2 = DivideCurve(Curve=line_3, Count=Slider(8, range=1..20), Kinks=False)  # -> Points, Tangents, Parameters
box = CenterBox(Base=PlaneXY(0, 0, 0), X=merge_5, Y=merge_6, Z=merge_7)
msphereex = MeshSphereEx(Base=pt, Radius=dist, Count=5)  # disabled
sunion = SolidUnion(Breps=box)
cullpt = CullDuplicates(Points=flatten(divide_2.Points), Tolerance=0.1, CullMode=3)  # -> Points, Indices, Valence
number_slider_13 = Slider(60, range=0..200)  # disabled
mesh_2 = MeshBrep(
    Brep=sunion,
    Settings={GridMaxCount=0, GridMinCount=16, JaggedSeams=False, MaxEdgeLength=0, MinEdgeLength=0.0001, MinTolerance=0, Refine=True, RefineAngle=0, RelativeTolerance=0.65, SimplePlanes=True, Tolerance=0})
num_3 = Number(number_slider)  # disabled
num_4 = Number(number_slider_12)  # disabled
item_2 = ListItem(List=cullpt.Points, Index=0, Wrap=True)  # -> Item, Item1
weld_2 = WeldMesh(Mesh=mesh_2, Angle=3.141592654)
lng = ListLength(List=pt)  # disabled
merge_8 = Merge(Data1=num_3, Data2=num_4, Data3=num_4)  # disabled
merge_9 = Merge(Data1=num_4, Data2=num_3, Data3=num_4)  # disabled
merge_10 = Merge(Data1=num_4, Data2=num_4, Data3=num_3)  # disabled
pt_2 = ConstructPoint(XCoordinate=0, YCoordinate=number_slider_13, ZCoordinate=0)  # disabled
lng_2 = ListLength(List=cullpt.Points)
dist_2 = Distance(PointA=item_2.Item, PointB=item_2.Item1)
xz = XZPlane(Origin=pt_2)  # disabled
box_2 = CenterBox(Base=PlaneXY(0, 0, 0), X=merge_8, Y=merge_9, Z=merge_10)  # disabled
number_slider_14 = Slider(0.99, range=0..1)  # disabled
rotate = Rotate(Geometry=xz, Angle=[0, 1.570796327, 3.141592654, 4.71238898], Plane=PlaneXY(0, 0, 0))  # -> Geometry, Transform; disabled
sunion_2 = SolidUnion(Breps=box_2)  # disabled
mesh_3 = MeshBrep(
    Brep=sunion_2,
    Settings={GridMaxCount=0, GridMinCount=16, JaggedSeams=False, MaxEdgeLength=0, MinEdgeLength=0.0001, MinTolerance=0, Refine=True, RefineAngle=0, RelativeTolerance=0.65, SimplePlanes=True, Tolerance=0})  # disabled
multiplication_3 = Multiplication(A=dist_2, B=Slider(1.2, range=0..2))
toggle = BooleanToggle(True)  # disabled
xy_4 = XYPlane(Origin=Point(0, 0, 0))
weld_3 = WeldMesh(Mesh=mesh_3, Angle=3.141592654)  # disabled

number_slider_15 = Slider(15, range=1..20)  # disabled
number_slider_16 = Slider(15, range=1..20)  # disabled
number_slider_17 = Slider(0.05, range=0..0.4)  # disabled
opts = FlexSolverOptions(
    TimeStep=number_slider_17,
    SubSteps=number_slider_16,
    NumIterations=number_slider_15,
    SceneMode=0,
    FixedNumberOfIteration=-1,
    MemoryRequirements=[131072, 96, 65536, 65536, 65536, 65536, 65536, 196608, 131972],
    StabilityScale=1)  # disabled

parameters = FlexParametersFromValues(
    Gravity=Vector(0, 0, -9.81),
    Radius=multiplication_3,
    SolidRestDistance=multiplication_3,
    FluidRestDistance=0.1,
    CollisionDistance=0.075,
    ParticleCollisionMargin=0.5,
    ShapeCollisionMargin=0.5,
    MaxSpeed=3.402823466e+38,
    MaxAcceleration=100,
    DynamicFriction=Slider(1, range=0..1),
    StaticFriction=0,
    ParticleFriction=0,
    Restitution=0,
    Adhesion=0,
    SleepThreshold=0,
    ShockPropagation=0,
    Dissipation=0,
    Damping=0,
    Fluid=True,
    Viscosity=0,
    Cohesion=0.025,
    SurfaceTension=0,
    SolidPressure=1,
    FreeSurfaceDrag=0,
    Buoyancy=1,
    PlasticThreshold=0,
    PlasticCreep=0,
    Wind=Vector(0, 0, 0),
    Drag=0,
    Lift=0,
    RelaxationMode=True,
    RelaxationFactor=1)
collgeometry = FlexCollisionGeometry(CollisionPlanes=flatten(xy_4))
xy_5 = XYPlane(Origin=Point(0, 0, 0))  # disabled
number_slider_18 = Slider(25, range=1..40)
radius = Number(dist)  # disabled
number_slider_19 = Slider(0.8, range=0..1)  # disabled
number_slider_20 = Slider(0.1, range=0..1)  # disabled
number_slider_21 = Slider(0.001, range=0..1)  # disabled
collgeometry_2 = FlexCollisionGeometry(CollisionPlanes=flatten([xy_5, rotate.Geometry]))  # disabled
opts_2 = FlexSolverOptions(
    TimeStep=Slider(0.025, range=0..1),
    SubSteps=number_slider_18,
    NumIterations=number_slider_18,
    SceneMode=0,
    FixedNumberOfIteration=-1,
    MemoryRequirements=[131072, 96, 65536, 65536, 65536, 65536, 65536, 196608, 131972],
    StabilityScale=1)
parameters_2 = FlexParametersFromValues(
    Gravity=Vector(0, 0, -9.81),
    Radius=radius,
    SolidRestDistance=radius,
    FluidRestDistance=0.1,
    CollisionDistance=radius,
    ParticleCollisionMargin=expr("x*2", radius),
    ShapeCollisionMargin=0.5,
    MaxSpeed=3.402823466e+38,
    MaxAcceleration=100,
    DynamicFriction=number_slider_19,
    StaticFriction=0,
    ParticleFriction=number_slider_19,
    Restitution=0,
    Adhesion=0,
    SleepThreshold=0,
    ShockPropagation=number_slider_21,
    Dissipation=0,
    Damping=number_slider_20,
    Fluid=True,
    Viscosity=0,
    Cohesion=0.025,
    SurfaceTension=0,
    SolidPressure=1,
    FreeSurfaceDrag=0,
    Buoyancy=1,
    PlasticThreshold=0,
    PlasticCreep=0,
    Wind=Vector(0, 0, 0),
    Drag=0,
    Lift=0,
    RelaxationMode=True,
    RelaxationFactor=1)  # disabled
button = Button()  # disabled
toggle_2 = BooleanToggle(False)  # disabled
swatch = ColourSwatch(SwatchColor=RGB(107, 100, 92))  # disabled
swatch_2 = ColourSwatch(SwatchColor=RGB(255, 255, 255))  # disabled

# ----
# Random Points
number_slider_22 = Slider(50, range=0.001..200)  # disabled
number_slider_23 = Slider(300, range=1..10000)  # disabled
number_slider_24 = Slider(2, range=0..50)  # disabled
dom = ConstructDomain(DomainStart=expr("x*-1", number_slider_22), DomainEnd=number_slider_22)  # disabled
random = Random(Range=dom, Number=expr("x*3", number_slider_23), Seed=number_slider_24)  # disabled
random_2 = Random(Range=Domain(-1, 1), Number=expr("x*3", number_slider_23), Seed=expr("x*3", number_slider_24))  # disabled
partition = PartitionList(List=random, Size=3)  # disabled
partition_2 = PartitionList(List=random_2, Size=3)  # disabled
item_3 = ListItem(List=partition, Index=0, Wrap=True)  # -> Item, Item1, Item2; disabled
item_4 = ListItem(List=partition_2, Index=0, Wrap=True)  # -> Item, Item1, Item2; disabled
pt_3 = ConstructPoint(XCoordinate=item_4.Item, YCoordinate=item_4.Item1, ZCoordinate=item_4.Item2)  # -> flatten(Point); disabled

multiplication_4 = Multiplication(A=item_3.Item2, B=number_slider_3)  # disabled
multiplication_5 = Multiplication(A=number_slider_22, B=number_slider_3)  # disabled

# ----
# Random Points
number_slider_25 = Slider(50, range=0.001..200)
number_slider_26 = Slider(300, range=1..10000)
number_slider_27 = Slider(2, range=0..50)
dom_2 = ConstructDomain(DomainStart=expr("x*-1", number_slider_25), DomainEnd=number_slider_25)
random_3 = Random(Range=dom_2, Number=expr("x*3", number_slider_26), Seed=number_slider_27)
random_4 = Random(Range=Domain(-1, 1), Number=expr("x*3", number_slider_26), Seed=expr("x*3", number_slider_27))
partition_3 = PartitionList(List=random_3, Size=3)
partition_4 = PartitionList(List=random_4, Size=3)
item_5 = ListItem(List=partition_3, Index=0, Wrap=True)  # -> Item, Item1, Item2
item_6 = ListItem(List=partition_4, Index=0, Wrap=True)  # -> Item, Item1, Item2
pt_4 = ConstructPoint(XCoordinate=item_6.Item, YCoordinate=item_6.Item1, ZCoordinate=item_6.Item2)  # -> flatten(Point)

multiplication_6 = Multiplication(A=item_5.Item2, B=number_slider_9)
multiplication_7 = Multiplication(A=number_slider_25, B=number_slider_9)

addition = Addition(A=multiplication_4, B=multiplication_5)  # disabled

addition_2 = Addition(A=addition, B=number_slider_2)  # disabled

pt_5 = ConstructPoint(XCoordinate=item_3.Item, YCoordinate=item_3.Item1, ZCoordinate=addition_2)  # -> flatten(Point); disabled

pl_2 = PlaneNormal(Origin=pt_5, ZAxis=pt_3)  # disabled
orient = Orient(Geometry=pt, Source=PlaneXY(0, 0, 0), Target=graft(pl_2))  # -> Geometry, Transform; disabled
flatten = FlattenTree(Tree=orient.Geometry, Path="{0}")  # disabled
lng_3 = ListLength(List=flatten)  # disabled
series = Series(Start=0, Step=1, Count=lng_3)  # disabled
int = Integer(series)  # disabled
partition_5 = PartitionList(List=int, Size=lng)  # disabled
shape_matching = ConstraintShapeMatchingConstraint(ParticleIndices=simplify(partition_5), Stiffness=number_slider_14)  # disabled
panel_4 = Panel(partition_5)  # disabled
particles = ParticlesFromPoints(Positions=flatten, SelfCollision=toggle)  # disabled
scene = FlexScene(Particles=flatten(particles), LocalConstraints=flatten(shape_matching))  # disabled
flex = FlexEngine(
    FlexParams=parameters_2,
    FlexCollisionGeometry=collgeometry_2,
    FlexScene=flatten(scene),
    FlexSolverOptions=opts,
    Reset=button,
    Go=toggle_2)  # -> FlexObject, Information; disabled
allparts = GetAllParticles(FlexObject=flex.FlexObject, N=1)  # -> Points, Vector; disabled
orient_2 = Orient(Geometry=weld_3, Source=PlaneXY(0, 0, 0), Target=pl_2)  # -> Geometry, Transform; disabled
cloud = CloudDisplay(Points=allparts.Points, Colours=swatch, Size=radius, SpriteType=0)  # disabled
transform = GetRigidTranformations(FlexObject=flex.FlexObject)  # -> Translations, RotationVectors, RotationAngles, Transformations; disabled
transform_2 = Transform(Geometry=orient_2.Geometry, Transform=transform.Transformations)  # disabled
preview = CustomPreview(Geometry=transform_2, Shader=swatch_2)  # disabled

addition_3 = Addition(A=multiplication_6, B=multiplication_7)

addition_4 = Addition(A=addition_3, B=Slider(30, range=0..100))

pt_6 = ConstructPoint(XCoordinate=item_5.Item, YCoordinate=item_5.Item1, ZCoordinate=addition_4)  # -> flatten(Point)

pl_3 = PlaneNormal(Origin=pt_6, ZAxis=pt_4)
orient_3 = Orient(Geometry=cullpt.Points, Source=PlaneXY(0, 0, 0), Target=graft(pl_3))  # -> Geometry, Transform
lng_4 = ListLength(List=flatten(orient_3.Geometry))
orient_4 = Orient(Geometry=weld_2, Source=PlaneXY(0, 0, 0), Target=graft(pl_3))  # -> Geometry, Transform
series_2 = Series(Start=0, Step=1, Count=lng_4)
partition_6 = PartitionList(List=series_2, Size=lng_2)
particles_2 = ParticlesFromPoints(Points=orient_3.Geometry)
shape_matching_2 = ConstraintShapeMatchingConstraint(ParticleIndices=partition_6)
scene_2 = FlexScene(Particles=flatten(particles_2), LocalConstraints=flatten(shape_matching_2))
flex_2 = FlexEngine(
    FlexParams=parameters,
    FlexCollisionGeometry=collgeometry,
    FlexScene=flatten(scene_2),
    FlexSolverOptions=opts_2,
    Reset=Button(),
    Go=Toggle(False))  # -> FlexObject, Information
transform_3 = GetRigidTranformations(FlexObject=flex_2.FlexObject)  # -> Translations, RotationVectors, RotationAngles, Transformations
allparts_2 = GetAllParticles(FlexObject=flex_2.FlexObject, N=1)  # -> Points, Vector
panel_5 = Panel(flex_2.Information)
transform_4 = Transform(Geometry=orient_4.Geometry, Transform=graft(transform_3.Transformations))
bake = InstantBake(Objects=flatten(transform_4), LayerName="Default", ClearLayer=False)
