# Grasshopper definition 12_big_mesh_ring_springs.gh (Grasshopper 1.0.7)
# plug-ins: FlexHopper, Kangaroo2 Components

# ----
# Mesh Resolution
number_slider = Slider(20, range=1..100)

# ----
# Elipse Radii
number_slider_2 = Slider(100, range=0..200)
pt = ConstructPoint(XCoordinate=0, YCoordinate=0, ZCoordinate=0)
pt_2 = ConstructPoint(XCoordinate=0, YCoordinate=0, ZCoordinate=number_slider_2)
xy = XYPlane(Origin=[pt, pt_2])
ellipse = Ellipse(
    Plane=xy,
    Radius1=[Slider(20, range=0..50), Slider(50, range=0..50)],
    Radius2=[Slider(20, range=0..50), Slider(50, range=0..50)])  # -> Ellipse, Focus1, Focus2
pipe = Pipe(Curve=ellipse.Ellipse, Radius=0.5, Caps=0)  # -> flatten(Pipe)
loft = Loft(Curves=ellipse.Ellipse, Options={Adjust=False, Closed=False, LoftEnds=0, LoftSimp=0, LoftType=0, Rebuild=10, Refit=0.01})
preview = CustomPreview(Geometry=pipe, Shader=ColourSwatch(SwatchColor=RGB(161, 161, 161)))  # disabled
mesh_uv = MeshSurface(Surface=loft, UCount=number_slider, VCount=number_slider, Overhang=True, Equalize=False)
tri = Triangulate(Mesh=mesh_uv)  # -> Mesh, Count
weld = WeldMesh(Mesh=tri.Mesh, Angle=3.141592654)
mesh = Mesh(weld)

# ----
# Mesh Resolution
number_slider_3 = Slider(20, range=1..100)  # disabled

# ----
# Elipse Radii
number_slider_4 = Slider(168.408, range=0..200)  # disabled
number_slider_5 = Slider(26.68, range=0..50)  # disabled
number_slider_6 = Slider(90.82, range=0..100)  # disabled
number_slider_7 = Slider(20, range=0..50)  # disabled
number_slider_8 = Slider(94.54, range=0..100)  # disabled
pt_3 = ConstructPoint(XCoordinate=0, YCoordinate=0, ZCoordinate=0)  # disabled
pt_4 = ConstructPoint(XCoordinate=0, YCoordinate=0, ZCoordinate=number_slider_4)  # disabled
xy_2 = XYPlane(Origin=[pt_3, pt_4])  # disabled
ellipse_2 = Ellipse(Plane=xy_2, Radius1=[number_slider_5, number_slider_6], Radius2=[number_slider_7, number_slider_8])  # -> Ellipse, Focus1, Focus2; disabled
loft_2 = Loft(
    Curves=ellipse_2.Ellipse,
    Options={Adjust=False, Closed=False, LoftEnds=0, LoftSimp=0, LoftType=0, Rebuild=10, Refit=0.01})  # disabled
mesh_uv_2 = MeshSurface(Surface=loft_2, UCount=number_slider_3, VCount=number_slider_3, Overhang=True, Equalize=False)  # disabled
tri_2 = Triangulate(Mesh=mesh_uv_2)  # -> Mesh, Count; disabled
weld_2 = WeldMesh(Mesh=tri_2.Mesh, Angle=3.141592654)  # disabled
mesh_2 = Mesh(weld_2)  # disabled

item = ListItem(List=ellipse.Ellipse, Index=0, Wrap=True)  # -> Item, Item1
item_2 = ListItem(List=ellipse_2.Ellipse, Index=0, Wrap=True)  # -> Item, Item1; disabled
number_slider_9 = Slider(275, range=0..500)  # disabled
nv = NakedVertices(Mesh=mesh_2)  # -> ClothedIndex, NakedIndex, ClothedPts, NakedPts; disabled
demesh = DeconstructMesh(Mesh=mesh)  # -> Vertices, Faces, Colours, Normals
number_slider_10 = Slider(-0.345, range=-2..2)  # disabled
number_slider_11 = Slider(0.176, range=-2..2)  # disabled
split = SplitList(List=nv.NakedIndex, Index=20)  # -> ListA, ListB; disabled
panel = Panel("0")  # disabled

# ----
# Only use this in Rhino 5!!!
sort_pt = SortPoints(Points=demesh.Vertices)  # -> Points, Indices

lng = ListLength(List=split.ListB)  # disabled
pt_5 = ConstructPoint(XCoordinate=0, YCoordinate=0, ZCoordinate=number_slider_9)  # disabled
int = Integer(split.ListA)  # disabled
panel_2 = Panel(split.ListB)  # disabled
dup = DuplicateData(Data=panel, Number=lng, Order=True)  # disabled
panel_3 = Panel(dup)  # disabled
number_slider_12 = Slider(0.001, range=0..1)
anchor = ConstraintsAnchors(AnchorIndex=panel)  # disabled
crv_cp = CurveClosestPoint(Point=demesh.Vertices, Curve=graft(item.Item1))  # -> Point, Parameter, Distance
particles = ParticlesFromPoints(Points=pt_5)  # disabled
shape_matching = ConstraintShapeMatchingConstraint(ParticleIndices=expr("x+1", split.ListB))  # disabled
springs = SpringSystemFromLinesMeshes(
    Springs=mesh_2,
    TargetSpringLength=number_slider_10,
    SpringStiffness=number_slider_11,
    SelfCollision=True,
    Anchors=int,
    GroupIndex=1)  # disabled
lng_2 = ListLength(List=demesh.Vertices)
addition = Addition(A=panel_2, B=1)  # disabled
crv_cp_2 = CurveClosestPoint(Point=demesh.Vertices, Curve=graft(item.Item))  # -> Point, Parameter, Distance
series = Series(Start=0, Step=1, Count=lng_2)
number_slider_13 = Slider(0.112, range=0..1)  # disabled
weave = Weave(Pattern=[0, 1], Stream0=panel_3, Stream1=addition, NullGaps=False)  # disabled
springs_2 = ConstraintsSprings(SpringPairIndices=weave, SpringStiffness=number_slider_13)  # disabled
smaller = SmallerThan(FirstNumber=crv_cp.Distance, SecondNumber=number_slider_12)  # -> SmallerThan, OrEqualTo
scene = FlexScene(
    Particles=flatten(particles),
    SpringSystems=flatten(springs),
    LocalConstraints=flatten([shape_matching, springs_2, anchor]))  # disabled
int_2 = Integer(series)
smaller_2 = SmallerThan(FirstNumber=crv_cp_2.Distance, SecondNumber=number_slider_12)  # -> SmallerThan, OrEqualTo
panel_4 = Panel(weave)  # disabled
toggle = BooleanToggle(False)  # disabled
button = Button()  # disabled
dispatch = Dispatch(List=int_2, DispatchPattern=smaller.SmallerThan)  # -> flatten(ListA), ListB
dispatch_2 = Dispatch(List=demesh.Vertices, DispatchPattern=smaller_2.SmallerThan)  # -> flatten(ListA), ListB
xy_3 = XYPlane(Origin=Point(0, 0, 0))  # disabled
collgeometry = FlexCollisionGeometry(CollisionPlanes=flatten(xy_3))  # disabled
flex = FlexEngine(FlexCollisionGeometry=collgeometry, FlexScene=flatten(scene), Reset=button, Go=toggle)  # -> FlexObject, Information; disabled
addition_2 = Addition(A=dispatch.ListA, B=1)

lng_3 = ListLength(List=dispatch.ListA)
series_2 = Series(Start=1, Step=1, Count=lng_3)
range = Range(Domain=Domain(0, 1), Steps=lng_3)
ins = InsertItems(List=addition_2, Item="0", Indices=series_2, Wrap=True)
graph = GraphMapper(
    range,
    x0=0,
    x1=1,
    y0=0,
    y1=1,
    container_name="Bezier",
    cpx=[0, 0.3676421642, 0.7158309221, 1],
    cpy=[0.1041463017, 0.2960842252, 0.08350670338, 0.06518113613])
panel_5 = Panel(graph)
springs_3 = ConstraintsSprings(SpringPairIndices=ins, TargetSpringLength=Slider(-0.134, range=-2..1), SpringStiffness=graph)

allsprings = GetAllSprings(FlexObject=flex.FlexObject, N=1)  # disabled

pt_6 = ConstructPoint(XCoordinate=0, YCoordinate=Slider(0, range=0..500), ZCoordinate=Slider(231.191, range=0..500))
particles_2 = ParticlesFromPoints(Positions=pt_6, GroupIndex=0)

number_slider_14 = Slider(0.856, range=-2..1)
springs_4 = SpringSystemFromLinesMeshes(
    Springs=mesh,
    TargetSpringLength=-0.01,
    SpringStiffness=Slider(0.877, range=-2..1),
    SelfCollision=Toggle(False),
    Anchors=dispatch_2.ListA,
    GroupIndex=3)  # -> flatten(SpringGroups)

shape_matching_2 = ConstraintShapeMatchingConstraint(ParticleIndices=expr("x+1", dispatch.ListA), Stiffness=Slider(1, range=0..1))

anchor_2 = ConstraintsAnchors(AnchorIndex="0")

opts = FlexSolverOptions(
    TimeStep=0.02,
    SubSteps=Slider(8, range=2..50),
    NumIterations=Slider(8, range=2..50),
    SceneMode=Slider(0, range=0..2),
    FixedNumberOfIteration=-1,
    MemoryRequirements=[131072, 96, 65536, 65536, 65536, 65536, 65536, 196608, 131972],
    StabilityScale=1)

scene_2 = FlexScene(
    Particles=flatten(particles_2),
    SpringSystems=flatten(springs_4),
    LocalConstraints=flatten([shape_matching_2, anchor_2, springs_3]))
reset = Button()
go = BooleanToggle(False)
flex_2 = FlexEngine(FlexScene=flatten(scene_2), FlexSolverOptions=opts, Reset=reset, Go=go)  # -> FlexObject, Information
panel_6 = Panel(flex_2.Information)
allsprings_2 = GetAllSprings(FlexObject=flex_2.FlexObject, N=1)
transform = GetRigidTranformations(FlexObject=flex_2.FlexObject)  # -> Translations, RotationVectors, RotationAngles, Transformations
transform_2 = Transform(Geometry=item.Item1, Transform=transform.Transformations)
preview_2 = CustomPreview(Geometry=allsprings_2, Shader=ColourSwatch(SwatchColor=RGB(255, 255, 255)))
