# Grasshopper definition 13_simple_soft_body.gh (Grasshopper 1.0.7)
# plug-ins: FlexHopper

number_slider = Slider(5, range=1..10)
number_slider_2 = Slider(5, range=1..10)
panel = Panel(number_slider_2)
panel_2 = Panel(number_slider_2)
number_slider_3 = Slider(-5, range=-50..50)  # disabled
number_slider_4 = Slider(50, range=-50..50)  # disabled
number_slider_5 = Slider(20, range=-50..50)  # disabled
number_slider_6 = Slider(30, range=-50..50)  # disabled
number_slider_7 = Slider(5, range=-50..50)  # disabled
rows_per_rigid = Slider(4, range=1..10)
number_slider_8 = Slider(5, range=1..10)
number_of_rows = Slider(5, range=1..10)
number_slider_9 = Slider(5, range=1..10)
panel_3 = Panel(number_slider_9)
panel_4 = Panel(number_slider_9)
number_slider_10 = Slider(40, range=-50..50)  # disabled
number_slider_11 = Slider(20, range=-50..50)  # disabled
number_slider_12 = Slider(50, range=-50..50)  # disabled
number_slider_13 = Slider(30, range=-50..50)  # disabled
number_slider_14 = Slider(50, range=-50..50)  # disabled
number_slider_15 = Slider(-5, range=-50..50)  # disabled
number_slider_16 = Slider(20, range=-50..50)  # disabled
number_slider_17 = Slider(50, range=-50..50)  # disabled
number_slider_18 = Slider(30, range=-50..50)  # disabled
number_slider_19 = Slider(5, range=-50..50)  # disabled
rows_per_rigid_2 = Slider(4, range=1..10)
number_of_rows_2 = Slider(5, range=1..10)
overlap = Slider(6, range=0..20)
overlap_2 = Slider(6, range=0..20)
dom = ConstructDomain(DomainStart=Slider(0, range=-10..50), DomainEnd=Slider(50, range=-10..50))
dom_2 = ConstructDomain(DomainStart=Slider(0, range=-10..50), DomainEnd=Slider(50, range=-10..50))
dom_3 = ConstructDomain(DomainStart=Slider(20, range=-10..50), DomainEnd=Slider(30, range=-10..50))
dom_4 = ConstructDomain(DomainStart=Slider(30, range=-10..50), DomainEnd=Slider(40, range=-10..50))
multiplication = Multiplication(A=panel_2, B=panel)
range = Range(Domain=dom, Steps=expr("x-1", Slider(25, range=1..30)))
dom_5 = ConstructDomain(DomainStart=Slider(20, range=-10..50), DomainEnd=Slider(30, range=-10..50))
dom_6 = ConstructDomain(DomainStart=Slider(-5, range=-10..10), DomainEnd=Slider(5, range=-10..10))
multiplication_2 = Multiplication(A=panel_3, B=panel_4)
number_slider_20 = Slider(25, range=0..100)  # disabled
range_2 = Range(Domain=dom_2, Steps=expr("x-1", Slider(25, range=1..30)))
number_slider_21 = Slider(5, range=0..10)  # disabled
number_slider_22 = Slider(5, range=0..10)  # disabled
number_slider_23 = Slider(4, range=1..10)  # disabled
number_slider_24 = Slider(25, range=0..100)  # disabled
number_slider_25 = Slider(25, range=0..100)  # disabled
number_slider_26 = Slider(5, range=0..10)  # disabled
number_slider_27 = Slider(5, range=0..10)  # disabled
number_slider_28 = Slider(5, range=0..10)  # disabled
range_3 = Range(Domain=dom_4, Steps=expr("x-1", number_slider_2))
number_slider_29 = Slider(4, range=1..10)  # disabled
range_4 = Range(Domain=dom_3, Steps=expr("x-1", number_slider))
number_slider_30 = Slider(5, range=0..10)  # disabled
number_slider_31 = Slider(4, range=1..10)  # disabled
range_5 = Range(Domain=dom_6, Steps=expr("x-1", number_slider_9))
range_6 = Range(Domain=dom_5, Steps=expr("x-1", number_slider_8))
dom_7 = ConstructDomain(DomainStart=number_slider_3, DomainEnd=number_slider_7)  # disabled
dom_8 = ConstructDomain(DomainStart=0, DomainEnd=number_slider_4)  # disabled
multiplication_3 = Multiplication(A=multiplication, B=rows_per_rigid)
dom_9 = ConstructDomain(DomainStart=number_slider_5, DomainEnd=number_slider_6)  # disabled
Y = UnitY(Factor=range)
dom_10 = ConstructDomain(DomainStart=number_slider_10, DomainEnd=number_slider_14)  # disabled
dom_11 = ConstructDomain(DomainStart=0, DomainEnd=number_slider_12)  # disabled
dom_12 = ConstructDomain(DomainStart=number_slider_11, DomainEnd=number_slider_13)  # disabled
multiplication_4 = Multiplication(A=multiplication_2, B=rows_per_rigid_2)
dom_13 = ConstructDomain(DomainStart=number_slider_15, DomainEnd=number_slider_19)  # disabled
dom_14 = ConstructDomain(DomainStart=0, DomainEnd=number_slider_17)  # disabled
dom_15 = ConstructDomain(DomainStart=number_slider_16, DomainEnd=number_slider_18)  # disabled
Y_2 = UnitY(Factor=range_2)
number_slider_32 = Slider(5, range=1..10)  # disabled
multiplication_5 = Multiplication(A=number_slider_2, B=number_slider)
number_slider_33 = Slider(5, range=1..10)  # disabled
number_slider_34 = Slider(5, range=1..10)  # disabled
pt = ConstructPoint(XCoordinate=graft(range_3), YCoordinate=0, ZCoordinate=range_4)  # -> flatten(Point)
panel_5 = Panel(multiplication_3)
multiplication_6 = Multiplication(A=number_slider_9, B=number_slider_8)
range_7 = Range(Domain=dom_7, Steps=expr("x-1", number_slider_21))  # disabled
range_8 = Range(Domain=dom_8, Steps=expr("x-1", number_slider_20))  # disabled
range_9 = Range(Domain=dom_9, Steps=expr("x-1", number_slider_22))  # disabled
pt_2 = ConstructPoint(XCoordinate=graft(range_5), YCoordinate=0, ZCoordinate=range_6)  # -> flatten(Point)
panel_6 = Panel(multiplication_4)
range_10 = Range(Domain=dom_10, Steps=expr("x-1", number_slider_26))  # disabled
range_11 = Range(Domain=dom_11, Steps=expr("x-1", number_slider_24))  # disabled
range_12 = Range(Domain=dom_12, Steps=expr("x-1", number_slider_27))  # disabled
multiplication_7 = Multiplication(A=multiplication, B=number_of_rows)
range_13 = Range(Domain=dom_13, Steps=expr("x-1", number_slider_28))  # disabled
range_14 = Range(Domain=dom_14, Steps=expr("x-1", number_slider_25))  # disabled
range_15 = Range(Domain=dom_15, Steps=expr("x-1", number_slider_30))  # disabled
move = Move(Geometry=pt, Motion=graft(Y))  # -> flatten(Geometry), Transform
multiplication_8 = Multiplication(A=multiplication_2, B=number_of_rows_2)
series = Series(Start=0, Step=multiplication_3, Count=overlap)
multiplication_9 = Multiplication(A=number_slider_21, B=number_slider_22)  # disabled
multiplication_10 = Multiplication(A=multiplication_9, B=number_slider_23)  # disabled
series_2 = Series(Start=0, Step=1, Count=multiplication_5)
multiplication_11 = Multiplication(A=number_slider_26, B=number_slider_27)  # disabled
multiplication_12 = Multiplication(A=multiplication_11, B=number_slider_29)  # disabled
series_3 = Series(Start=0, Step=multiplication_4, Count=overlap_2)
series_4 = Series(Start=0, Step=1, Count=multiplication_6)
multiplication_13 = Multiplication(A=number_slider_28, B=number_slider_30)  # disabled
multiplication_14 = Multiplication(A=multiplication_13, B=number_slider_31)  # disabled
move_2 = Move(Geometry=pt_2, Motion=graft(Y_2))  # -> flatten(Geometry), Transform
number_slider_35 = Slider(6, range=0..20)  # disabled
multiplication_15 = Multiplication(A=multiplication_9, B=number_slider_32)  # disabled
pt_3 = ConstructPoint(XCoordinate=graft(range_7), YCoordinate=0, ZCoordinate=range_9)  # disabled
number_slider_36 = Slider(6, range=0..20)  # disabled
series_5 = Series(Start=0, Step=1, Count=multiplication_9)  # disabled
multiplication_16 = Multiplication(A=multiplication_11, B=number_slider_33)  # disabled
series_6 = Series(Start=series, Step=1, Count=multiplication_7)  # -> simplify(Series)
number_slider_37 = Slider(6, range=0..20)  # disabled
panel_7 = Panel(series)
multiplication_17 = Multiplication(A=multiplication_13, B=number_slider_34)  # disabled
Y_3 = UnitY(Factor=range_8)  # disabled
pt_4 = ConstructPoint(XCoordinate=graft(range_10), YCoordinate=0, ZCoordinate=range_12)  # disabled
panel_8 = Panel(series_2)
pt_5 = ConstructPoint(XCoordinate=graft(range_13), YCoordinate=0, ZCoordinate=range_15)  # disabled
series_7 = Series(Start=0, Step=1, Count=multiplication_11)  # disabled
series_8 = Series(Start=series_3, Step=1, Count=multiplication_8)  # -> simplify(Series)
series_9 = Series(Start=0, Step=1, Count=multiplication_13)  # disabled
panel_9 = Panel(series_3)
Y_4 = UnitY(Factor=range_11)  # disabled
series_10 = Series(Start=0, Step=multiplication_10, Count=number_slider_35)  # disabled
Y_5 = UnitY(Factor=range_14)  # disabled
panel_10 = Panel(series_4)
series_11 = Series(Start=0, Step=multiplication_12, Count=number_slider_36)  # disabled
number_slider_38 = Slider(0.976, range=0..1)  # disabled
series_12 = Series(Start=0, Step=multiplication_14, Count=number_slider_37)  # disabled
particles = ParticlesFromPoints(Points=flatten(move.Geometry))
number_slider_39 = Slider(0.976, range=0..1)  # disabled
number_slider_40 = Slider(0.976, range=0..1)  # disabled
series_13 = Series(Start=series_10, Step=1, Count=multiplication_15)  # -> simplify(Series); disabled
particles_2 = ParticlesFromPoints(Points=flatten(move_2.Geometry))
series_14 = Series(Start=series_11, Step=1, Count=multiplication_16)  # -> simplify(Series); disabled
series_15 = Series(Start=series_12, Step=1, Count=multiplication_17)  # -> simplify(Series); disabled
move_3 = Move(Geometry=flatten(pt_3), Motion=graft(Y_3))  # -> flatten(Geometry), Transform; disabled
move_4 = Move(Geometry=flatten(pt_4), Motion=graft(Y_4))  # -> flatten(Geometry), Transform; disabled
move_5 = Move(Geometry=flatten(pt_5), Motion=graft(Y_5))  # -> Geometry, Transform
anchor = ConstraintsAnchors(AnchorIndex=series_2)
shape_matching = ConstraintShapeMatchingConstraint(ParticleIndices=series_6, Stiffness=Slider(0.969, range=0..1))
anchor_2 = ConstraintsAnchors(AnchorIndex=series_4)
shape_matching_2 = ConstraintShapeMatchingConstraint(ParticleIndices=series_8, Stiffness=Slider(0.969, range=0..1))
shape_matching_3 = ConstraintShapeMatchingConstraint(ParticleIndices=series_13, Stiffness=number_slider_38)  # disabled
anchor_3 = ConstraintsAnchors(AnchorIndex=series_5)  # disabled
shape_matching_4 = ConstraintShapeMatchingConstraint(ParticleIndices=series_14, Stiffness=number_slider_39)  # disabled
shape_matching_5 = ConstraintShapeMatchingConstraint(ParticleIndices=series_15, Stiffness=number_slider_40)  # disabled
anchor_4 = ConstraintsAnchors(AnchorIndex=series_7)  # disabled
anchor_5 = ConstraintsAnchors(AnchorIndex=series_9)  # disabled
number_slider_41 = Slider(0, range=0..20)  # disabled
panel_11 = Panel("""620
1225""")
particles_3 = ParticlesFromPoints(Points=move_3.Geometry)  # disabled
merge = Merge(Data1=move_2.Geometry, Data2=move.Geometry)
number_slider_42 = Slider(0.956, range=0..1)  # disabled
particles_4 = ParticlesFromPoints(Points=move_4.Geometry)  # disabled
particles_5 = ParticlesFromPoints(Points=move_5.Geometry)  # disabled
scene = FlexScene(Particles=flatten(particles), LocalConstraints=flatten([anchor, shape_matching]))
merge_2 = Merge(Data2=move_3.Geometry, Data3=move_4.Geometry)  # disabled
scene_2 = FlexScene(Particles=flatten(particles_2), LocalConstraints=flatten([anchor_2, shape_matching_2]))
springs = ConstraintsSprings(SpringPairIndices=panel_11, TargetSpringLength=Slider(0, range=0..1))
button = Button()  # disabled
toggle = BooleanToggle(False)  # disabled
number_slider_43 = Slider(620, range=0..1250)  # disabled
number_slider_44 = Slider(1225, range=0..1250)  # disabled
item = ListItem(List=merge, Index=Slider(1236, range=0..1250), Wrap=True)
scene_3 = FlexScene(Particles=flatten(particles_3), LocalConstraints=flatten([anchor_3, shape_matching_3]))  # disabled
scene_4 = FlexScene(Particles=flatten(particles_4), LocalConstraints=flatten([anchor_4, shape_matching_4]))  # disabled
scene_5 = FlexScene(Particles=flatten(particles_5), LocalConstraints=flatten([anchor_5, shape_matching_5]))  # disabled
opts = FlexSolverOptions(
    TimeStep=0.01666666667,
    SubSteps=3,
    NumIterations=3,
    SceneMode=0,
    FixedNumberOfIteration=-1,
    MemoryRequirements=[131072, 96, 65536, 65536, 65536, 65536, 65536, 196608, 131972],
    StabilityScale=1)  # disabled
springs_2 = ConstraintsSprings(
    SpringPairIndices=[number_slider_43, number_slider_44],
    TargetSpringLength=number_slider_41,
    SpringStiffness=number_slider_42)  # disabled
item_2 = ListItem(List=merge_2, Index=number_slider_44, Wrap=True)  # disabled
flex = FlexEngine(FlexScene=flatten(scene_5), FlexSolverOptions=opts, Reset=button, Go=toggle)  # -> FlexObject, Information; disabled
merge_3 = Merge(Data1=scene_3, Data2=scene_4)  # disabled
opts_2 = FlexSolverOptions(
    TimeStep=0.01666666667,
    SubSteps=3,
    NumIterations=3,
    SceneMode=0,
    FixedNumberOfIteration=-1,
    MemoryRequirements=[131072, 96, 65536, 65536, 65536, 65536, 65536, 196608, 131972],
    StabilityScale=1)  # disabled
toggle_2 = BooleanToggle(False)  # disabled
button_2 = Button()  # disabled
allparts = GetAllParticles(FlexObject=flex.FlexObject, N=1)  # -> Points, Vector; disabled
flex_2 = FlexEngine(FlexScene=flatten([scene_2, scene]), GlobalConstraints=flatten(springs), Reset=Button(), Go=Toggle(False))  # -> FlexObject, Information
flex_3 = FlexEngine(FlexScene=flatten(merge_3), GlobalConstraints=flatten(springs_2), FlexSolverOptions=opts_2, Reset=button_2, Go=toggle_2)  # -> FlexObject, Information; disabled
soft = SoftFromMesh(Velocities=Vector(0, 0, 0), Mass=1, GroupIndex=0)  # -> Particles, SpringIndices, ShapeMatchingConstraintIndices, SpringLines, ShapeMatchingConstraintBoundingBox, SoftBodies
allsprings = GetAllSprings(FlexObject=flex_2.FlexObject, N=1)
allparts_2 = GetAllParticles(FlexObject=flex_2.FlexObject, N=1)  # -> Points, Vector
allparts_3 = GetAllParticles(FlexObject=flex_3.FlexObject, N=1)  # -> Points, Vector; disabled
allsprings_2 = GetAllSprings(FlexObject=flex_3.FlexObject, N=1)  # disabled
