# Grasshopper definition 15_soft_shell.gh (Grasshopper 1.0.7)
# plug-ins: FlexHopper

number_slider = Slider(9, range=1..40)
srf = Surface(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)
sdivide = DivideSurface(Surface=srf, UCount=expr("x*4", number_slider), VCount=number_slider)  # -> Points, Normals, Parameters
flip = FlipMatrix(Data=sdivide.Points)
custom_mesh_settings = SettingsCustom(
    StitchSeams=True,
    SimplePlanes=False,
    Refine=True,
    MinCount=16,
    MaxCount=400,
    AspectRatio=20,
    MaxDistance=0,
    MaxAngle=20,
    MinEdge=5,
    MaxEdge=0)
shift = ShiftList(List=sdivide.Points, Shift=-1, Wrap=False)  # -> simplify(graft(List))
shift_2 = ShiftList(List=sdivide.Points, Shift=1, Wrap=False)  # -> simplify(graft(List))
shift_3 = ShiftList(List=flip, Shift=1, Wrap=False)
shift_4 = ShiftList(List=flip, Shift=-1, Wrap=False)
mesh = MeshBrep(Brep=srf, Settings=custom_mesh_settings)
flip_2 = FlipMatrix(Data=shift_3)  # -> simplify(Data)
flip_3 = FlipMatrix(Data=shift_4)  # -> simplify(graft(Data))
graft = GraftTree(Tree=flip_2, IncludeEmptyLists=True, IncludeNullItems=True)
shift_5 = ShiftList(List=flip_2, Shift=1, Wrap=False)  # -> simplify(graft(List))
merge = Merge(Data1=shift_2, Data2=shift, Data3=graft, Data4=shift_5)
quad = MeshQuad(CornerA=0, CornerB=1, CornerC=2, CornerD=3)
conmesh = ConstructMesh(Vertices=merge, Faces=quad)  # -> flatten(Mesh)
vec = VectorXYZ(XComponent=Slider(12.121, range=0..200), YComponent=0, ZComponent=0)  # -> Vector, Length
mjoin = MeshJoin(Meshes=conmesh)
number_slider_2 = Slider(0.25, range=0..1)
tri = Triangulate(Mesh=mjoin)  # -> Mesh, Count
panel = Panel("""30
40
0.01
25
0.1
0.1""")
weld = WeldMesh(Mesh=tri.Mesh, Angle=3.141592654)
demesh = DeconstructMesh(Mesh=weld)  # -> Vertices, Faces, Colours, Normals
deface = DeconstructFace(Face=demesh.Faces)  # -> CornerA, CornerB, CornerC, CornerD
merge_2 = Merge(Data1=graft(deface.CornerA), Data2=graft(deface.CornerB), Data3=graft(deface.CornerC))
triangles = ConstraintsTriangles(TriangleIndices=merge_2)
parameters = FlexParametersFromValues(
    Gravity=Vector(0, 0, -9.81),
    Radius=0.15,
    SolidRestDistance=0.15,
    FluidRestDistance=0.1,
    CollisionDistance=0.075,
    ParticleCollisionMargin=0.5,
    ShapeCollisionMargin=0.5,
    MaxSpeed=3.402823466e+38,
    MaxAcceleration=100,
    DynamicFriction=0,
    StaticFriction=0,
    ParticleFriction=0,
    Restitution=0,
    Adhesion=0,
    SleepThreshold=0,
    ShockPropagation=0,
    Dissipation=0,
    Damping=0,
    Fluid=True,
    Viscosity=0,
    Cohesion=0.025,
    SurfaceTension=0,
    SolidPressure=1,
    FreeSurfaceDrag=0,
    Buoyancy=1,
    PlasticThreshold=0,
    PlasticCreep=0,
    Wind=vec.Vector,
    Drag=number_slider_2,
    Lift=number_slider_2,
    RelaxationMode=True,
    RelaxationFactor=1)
soft = SoftFromMesh(SoftBodyMesh=weld, Velocities=Vector(0, 0, 0), Mass=1, SoftParams=panel, GroupIndex=0)  # -> Particles, SpringIndices, ShapeMatchingConstraintIndices, SpringLines, ShapeMatchingConstraintBoundingBox, SoftBodies
pt = Point(soft.Particles)
crv = Curve(soft.SpringLines)
pdecon = Deconstruct(Point=pt)  # -> XComponent, YComponent, ZComponent
lng = ListLength(List=pt)
opts = FlexSolverOptions(
    TimeStep=0.01666666667,
    SubSteps=3,
    NumIterations=3,
    SceneMode=0,
    FixedNumberOfIteration=-1,
    MemoryRequirements=[131072, 96, 65536, 65536, 65536, 65536, 65536, 196608, 131972],
    StabilityScale=1)
smaller = SmallerThan(FirstNumber=pdecon.ZComponent, SecondNumber=Slider(1.554, range=-2..4))  # -> SmallerThan, OrEqualTo
series = Series(Start=0, Step=1, Count=lng)
dispatch = Dispatch(List=series, DispatchPattern=smaller.SmallerThan)  # -> ListA, ListB
anchor = ConstraintsAnchors(AnchorIndex=dispatch.ListA)
scene = FlexScene(SoftBodies=flatten(soft.SoftBodies), LocalConstraints=flatten(anchor))
flex = FlexEngine(FlexParams=parameters, FlexScene=flatten(scene), FlexSolverOptions=opts, Reset=Button(), Go=Toggle(False))  # -> FlexObject, Information
item = ListItem(List=pt, Index=dispatch.ListA, Wrap=True)
transform = GetRigidTranformations(FlexObject=flex.FlexObject)  # -> Translations, RotationVectors, RotationAngles, Transformations
msphereex = MeshSphereEx(Base=item, Radius=4, Count=3)
softs = GetSoftBodies(FlexObject=flex.FlexObject, Softs=soft.SoftBodies)  # -> Points, Velocity, SpringLines, ShapeMatchingBoxes, Mesh
mesh_2 = Mesh(softs.Mesh)
