# Grasshopper definition 170629_cloth_demo.gh (Grasshopper 0.9.76)
# plug-ins: ExtraUtil, FlexHopper, Weaverbird

number_slider = Slider(42.8, range=0..100)

# ----
# CAREFUL!
# go slow one this one
# complexity grows
# quadratically with increased level
number_slider_2 = Slider(3, range=1..15)

mesh = Mesh(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)
wbtriangles = WeaverbirdsSplitTrianglesSubdivision(MeshCurves=mesh, Level=number_slider_2)
tri = Triangulate(Mesh=wbtriangles)  # -> Mesh, Count
weld = WeldMesh(Mesh=tri.Mesh, Angle=3.141592654)
anchors = Point([Point(-15, -15, 0), Point(15, -15, 0), Point(15, 15, 0), Point(-15, 15, 0)])
mesh_2 = Mesh(weld)
vec = VectorXYZ(
    XComponent=[Slider(0, range=0..100), Slider(25, range=0..100), Slider(50, range=0..100)],
    YComponent=0,
    ZComponent=[Slider(20, range=0..100), Slider(40, range=0..100), Slider(60, range=0..100)])  # -> Vector, Length
move = Move(Geometry=mesh_2, Motion=graft(vec.Vector))  # -> flatten(Geometry), Transform
move_2 = Move(Geometry=anchors, Motion=graft(vec.Vector))  # -> Geometry, Transform
item = ListItem(List=move_2.Geometry, Index=[0, 1, 2, 3], Wrap=True)

c_script = CSharpScript(
    xRange=number_slider,
    xInt=Slider(2, range=1..4),
    yRange=Slider(70, range=0..100),
    yInt=Slider(2, range=1..4),
    size=Slider(61.6, range=0..100))  # -> boxes; inputs xRange: Double, xInt: Int32, yRange: Double, yInt: Int32, size: Double
# ---------- c_script: C# ----------
    List<Box> bxs = new List<Box>();

    for(int i = -xInt; i < xInt;i++)
    {
      for(int j = -yInt; j < yInt; j++)
      {
        Plane pln = new Plane(new Point3d(i * xRange, j * yRange, 0.0),
          new Vector3d((rnd.NextDouble() - 1.0) * 2.0,
          (rnd.NextDouble() - 1.0) * 2.0,
          (rnd.NextDouble() - 1.0) * 2.0));
        Interval iv = new Interval(-size * 0.5, size * 0.5);
        bxs.Add(new Box(pln, iv, iv, iv));
      }
    }


    boxes = bxs;
# ---------- c_script: C# additional code ----------
  Random rnd = new Random();
# ---------- end c_script ----------
vec_2 = VectorXYZ(XComponent=0, YComponent=expr("x*0.5", number_slider), ZComponent=0)  # -> Vector, Length
rotate = Rotate(Geometry=c_script, Angle=1.570796327, Plane=PlaneXY(0, 0, 0))  # -> Geometry, Transform
move_3 = Move(Geometry=rotate.Geometry, Motion=vec_2.Vector)  # -> Geometry, Transform
scale = Scale(Geometry=move_3.Geometry, Center=Point(0, 0, 0), Factor=0.8)  # -> Geometry, Transform

# ----
# Play with me!
number_slider_3 = Slider(0, range=-10..10)
vec_3 = VectorXYZ(XComponent=number_slider_3, YComponent=Slider(2.92, range=-10..10), ZComponent=Slider(0, range=-10..10))  # -> Vector, Length; disabled

box = Box([{Plane=Plane(origin=(112, -51.36, 0), x=(0.8117504629, 0.58400444, 0), y=(0.2781396103, -0.3866065768, 0.8793029694)), X=Domain(-24.64, 24.64), Y=Domain(-24.64, 24.64), Z=Domain(-24.64, 24.64)}, {Plane=Plane(origin=(56, -51.36, 0), x=(0, 0.6528458054, -0.7574908279), y=(0.9065439422, 0.3197455558, 0.2755736931)), X=Domain(-24.64, 24.64), Y=Domain(-24.64, 24.64), Z=Domain(-24.64, 24.64)}, {Plane=Plane(origin=(0, -51.36, 0), x=(-0.4396647922, 0, -0.89816194), y=(0.3165269051, 0.9358433381, -0.1549450381)), X=Domain(-24.64, 24.64), Y=Domain(-24.64, 24.64), Z=Domain(-24.64, 24.64)}, {Plane=Plane(origin=(-56, -51.36, 0), x=(0.9513079834, 0.308241984, 0), y=(0.01950865549, -0.06020834501, 0.9979951741)), X=Domain(-24.64, 24.64), Y=Domain(-24.64, 24.64), Z=Domain(-24.64, 24.64)}, {Plane=Plane(origin=(112, -17.12, 0), x=(0, -0.9049828953, 0.4254479512), y=(-0.989181087, -0.06241305088, -0.1327606428)), X=Domain(-24.64, 24.64), Y=Domain(-24.64, 24.64), Z=Domain(-24.64, 24.64)}, {Plane=Plane(origin=(-56, -17.12, 0), x=(0, 0.6820365731, -0.7313180655), y=(0.839506272, 0.3973616687, 0.3705845699)), X=Domain(-24.64, 24.64), Y=Domain(-24.64, 24.64), Z=Domain(-24.64, 24.64)}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])
number_slider_4 = Slider(0.9, range=0..1)
number_slider_5 = Slider(0.1, range=0..1)
preview = CustomPreview(Geometry=box, Shader=ColourSwatch(SwatchColor=RGBA(150, 150, 150, 0)))

# ----
# If "Lock Mode" on the
# engine component is
# set false, you can change
# these during runtime
# Right click me to save
# params to .xml
# Alternatively use
# "FlexParameters from .xml file"
# which is more neat
number_slider_6 = Slider(0, range=-10..10)
vec_4 = VectorXYZ(XComponent=number_slider_6, YComponent=0, ZComponent=Slider(-9.81, range=-10..10))  # -> Vector, Length
parameters = FlexParametersFromValues(
    Gravity=vec_4.Vector,
    Radius=number_slider_4,
    SolidRestDistance=expr("x*0.8", number_slider_4),
    FluidRestDistance=expr("x*0.9", number_slider_4),
    CollisionDistance=number_slider_4,
    ParticleCollisionMargin=expr("x/2", number_slider_4),
    ShapeCollisionMargin=0.5,
    MaxSpeed=3.402823466e+38,
    MaxAcceleration=1000,
    DynamicFriction=number_slider_5,
    StaticFriction=number_slider_5,
    ParticleFriction=expr("x*0.2", number_slider_5),
    Restitution=0,
    Adhesion=0,
    SleepThreshold=0,
    ShockPropagation=0,
    Dissipation=0,
    Damping=Slider(0.1, range=0..1),
    Fluid=True,
    Viscosity=0,
    VorticityConfinement=0,
    Cohesion=Slider(0.018, range=0..100),
    SurfaceTension=0,
    SolidPressure=1,
    FreeSurfaceDrag=0,
    Buoyancy=1,
    PlasticThreshold=0,
    PlasticCreep=0,
    Wind=Vector(0, 0, 0),
    Drag=Slider(0.5, range=0..1),
    Lift=Slider(0.25, range=0..1),
    RelaxationMode=True,
    RelaxationFactor=1)

xy = XYPlane(Origin=Point(0, 0, 0))
collgeometry = FlexCollisionGeometry(CollisionPlanes=flatten(xy), CollisionBoxes=flatten(box))

# ----
# Move me!
pt = Point([Point(62.13453892, 0, 89.91855221), Point(63.86546108, 0, 93.08144779)])

opts = FlexSoverOptions(TimeStep=Slider(0.0167, range=0..0.2), SubSteps=Slider(15, range=1..30), NumIterations=Slider(3, range=1..10))

lng = ListLength(List=move.Geometry)
item_2 = ListItem(List=pt, Index=0, Wrap=True)  # -> Item, Item1
vec2pt = Vector2Pt(PointA=item_2.Item1, PointB=item_2.Item, Unitize=False)  # -> Vector, Length
timer = Timer(TimerInterval=20, Target=gun)
dup = DuplicateData(Data=Slider(0.3, range=0..1), Number=lng, Order=True)

panel = Panel("""1
2
3""")
cloth = ClothFromMesh(
    ClothMeshes=flatten(move.Geometry),
    Masses=graft(dup),
    StretchStiffness=Slider(0.7, range=0..1),
    BendingStiffness=Slider(0.1, range=0..1),
    PreTension=0.9,
    Anchors=item,
    GroupIndex=panel)

pl = PlaneNormal(Origin=item_2.Item, ZAxis=vec2pt.Vector)
gun = ParticleGun(
    OriginPlane=pl,
    ParticleCount=Slider(5, range=1..100),
    Diameter=Slider(2.1, range=0..100),
    Angle=Slider(0.04, range=0..3.14),
    Velocity=Slider(72.37, range=0..100))  # -> Points, Velocities

# ----
# Try adding more stuff
# here durng runtime
panel_2 = Panel(cloth)

scene = FlexScene(Cloths=flatten(cloth))
fluid = FluidFromPoints(Positions=gun.Points, Velocities=gun.Velocities, Masses=1, GroupIndex="0")
scene_2 = FlexScene(Fluids=flatten(fluid))

go = BooleanToggle(False)
reset = Button()

flex = FlexEngine(
    FlexParams=parameters,
    FlexCollisionGeometry=collgeometry,
    FlexScene=flatten([scene, scene_2]),
    FlexSolverOptions=opts,
    LockMode=Toggle(False),
    Reset=reset,
    Go=go)  # -> FlexObject, Information
panel_3 = Panel(scene_2)
panel_4 = Panel(flex.Information)

# ----
# Enable me if you need me
# as I slow down simulation
number_slider_7 = Slider(22, range=1..100)
allsprings = GetAllSprings(FlexObject=flex.FlexObject, N=number_slider_7)  # disabled
preview_2 = CustomPreview(Geometry=allsprings, Shader=ColourSwatch(SwatchColor=RGB(255, 255, 255)))

# ----
# Enable me if you need me
# as I slow down simulation
toggle = BooleanToggle(False)
cloths = GetCloths(FlexObject=flex.FlexObject, N=1, DrawParticles=toggle, ClothObject=cloth)  # -> Points, Vector, Meshes

fluids = GetFluids(FlexObject=flex.FlexObject, N=1)  # -> Points, Vector
bake = InstantBake(Objects=flatten([fluids.Points, cloths.Meshes]), LayerName="Layer 02", MaterialName="Default material")
instant_bake = InstantBake(LayerName="Default", Points=fluids.Points, Mesh=flatten(cloths.Meshes))  # disabled
