# Grasshopper definition 170713_softBodyDemo.gh (Grasshopper 0.9.76)
# plug-ins: FlexHopper

mesh = Mesh(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)
vec = VectorXYZ(XComponent=15, YComponent=0, ZComponent=0)  # -> Vector, Length
vec_2 = VectorXYZ(XComponent=15, YComponent=0, ZComponent=0)  # -> Vector, Length
vec_3 = VectorXYZ(XComponent=15, YComponent=0, ZComponent=0)  # -> Vector, Length
xy = XYPlane(Origin=Point(0, 0, 0))
panel = Panel("""1
2
0
1.5
2
0.1
1.5
0.0
0.0""")
move = Move(Geometry=mesh, Motion=vec_2.Vector)  # -> Geometry, Transform
move_2 = Move(Geometry=move.Geometry, Motion=vec.Vector)  # -> Geometry, Transform
move_3 = Move(Geometry=move_2.Geometry, Motion=vec_3.Vector)  # -> Geometry, Transform
collgeometry = FlexCollisionGeometry(CollisionPlanes=flatten(xy))
soft = SoftFromMesh(SoftBodyMesh=flatten(mesh), Velocities=Vector(0, 0, 0), Mass=1, SoftParams=panel, GroupIndex=0)  # -> Particles, SpringIndices, simplify(ShapeMatchingConstraintIndices), SpringLines, ShapeMatchingConstraintBoundingBox, SoftBodies
rigid = RigidFromMesh(RigidBodyMesh=[move_3.Geometry, move_2.Geometry], Velocities=Vector(0, 0, 0), Mass=1, Stiffness=1, GroupIndex=0)  # disabled
shape_matching = ConstraintShapeMatchingConstraint(ParticleIndices=soft.ShapeMatchingConstraintIndices, Stiffness=Slider(0.25, range=0..1))
scene = FlexScene(RigidBodies=flatten(rigid), SoftBodies=flatten(soft.SoftBodies))
panel_2 = Panel(scene)
flex = FlexEngine(FlexCollisionGeometry=collgeometry, FlexScene=flatten(scene), LockMode=False, Reset=Button(), Go=Toggle(False))  # -> FlexObject, Information
softs = GetSoftBodies(FlexObject=flex.FlexObject, Softs=soft.SoftBodies)  # -> Points, Velocity, SpringLines, ShapeMatchingBoxes
panel_3 = Panel(flex.Information)
rigids = GetRigids(FlexObject=flex.FlexObject, N=1, Deformable=False, Rigids=rigid)  # -> Points, Vector, Meshes
panel_4 = Panel(rigids.Points)
