# Grasshopper definition 170725_wind_cloth_demo.gh (Grasshopper 0.9.76)
# plug-ins: FlexHopper, Weaverbird

# ----
# CAREFUL!
# go slow one this one
# complexity grows
# quadratically with increased level
number_slider = Slider(3, range=1..15)

# ----
# If "Lock Mode" on the
# engine component is
# set false, you can change
# these during runtime
number_slider_2 = Slider(-5, range=-20..20)
vec = VectorXYZ(XComponent=number_slider_2, YComponent=Slider(5, range=-20..20), ZComponent=Slider(0, range=-20..20))  # -> Vector, Length
number_slider_3 = Slider(0.112, range=0..1)
number_slider_4 = Slider(0.1, range=0..1)
number_slider_5 = Slider(0.1, range=0..1)

# ----
# Right click me to save
# params to .xml
# Alternatively use
# "FlexParameters from .xml file"
# which is more neat
# Play with me!
number_slider_6 = Slider(0, range=-10..10)
vec_2 = VectorXYZ(XComponent=number_slider_6, YComponent=0, ZComponent=Slider(-9.81, range=-10..10))  # -> Vector, Length
parameters = FlexParametersFromValues(
    Gravity=vec_2.Vector,
    Radius=number_slider_3,
    SolidRestDistance=expr("x*0.8", number_slider_3),
    FluidRestDistance=expr("x*0.9", number_slider_3),
    CollisionDistance=number_slider_3,
    ParticleCollisionMargin=expr("x/2", number_slider_3),
    ShapeCollisionMargin=0.5,
    MaxSpeed=3.402823466e+38,
    MaxAcceleration=1000,
    DynamicFriction=number_slider_4,
    StaticFriction=number_slider_4,
    ParticleFriction=expr("x*0.2", number_slider_4),
    Restitution=0,
    Adhesion=0,
    SleepThreshold=0,
    ShockPropagation=0,
    Dissipation=0,
    Damping=0,
    Fluid=True,
    Viscosity=0,
    Cohesion=Slider(0.018, range=0..100),
    SurfaceTension=0,
    SolidPressure=1,
    FreeSurfaceDrag=0,
    Buoyancy=1,
    PlasticThreshold=0,
    PlasticCreep=0,
    Wind=vec.Vector,
    Drag=Slider(0.013, range=0..1),
    Lift=Slider(0.003, range=0..1),
    RelaxationMode=True,
    RelaxationFactor=1)

xy = XYPlane(Origin=Point(0, 0, 0))
collgeometry = FlexCollisionGeometry(CollisionPlanes=flatten(xy))

opts = FlexSoverOptions(TimeStep=Slider(0.05, range=0..0.2), SubSteps=Slider(30, range=1..30), NumIterations=Slider(9, range=1..10))

go = BooleanToggle(False)
reset = Button()

# ----
# Enable me if you need me
# as I slow down simulation
number_slider_7 = Slider(22, range=1..100)
allsprings = GetAllSprings(N=number_slider_7)
preview = CustomPreview(Geometry=allsprings, Shader=ColourSwatch(SwatchColor=RGB(255, 255, 255)))

panel = Panel("Default")

mesh = Mesh(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)
anchors = Point([Point(-15, -15, 0), Point(15, -15, 0), Point(15, 15, 0), Point(-15, 15, 0)])
vec_3 = VectorXYZ(XComponent=Slider(0, range=0..100), YComponent=0, ZComponent=Slider(50, range=0..100))  # -> Vector, Length
move = Move(Geometry=anchors, Motion=graft(vec_3.Vector))  # -> Geometry, Transform
item = ListItem(List=move.Geometry, Index=[0, 1, 2], Wrap=True)

wbtriangles = WeaverbirdsSplitTrianglesSubdivision(MeshCurves=mesh, Level=number_slider)

tri = Triangulate(Mesh=wbtriangles)  # -> Mesh, Count
weld = WeldMesh(Mesh=tri.Mesh, Angle=3.141592654)
mesh_2 = Mesh(weld)
move_2 = Move(Geometry=mesh_2, Motion=graft(vec_3.Vector))  # -> flatten(Geometry), Transform

# ----
# Try adding more stuff
# here durng runtime
cloth = ClothFromMesh(
    ClothMeshes=move_2.Geometry,
    Masses=Slider(0.3, range=0..1),
    StretchStiffness=Slider(0.775, range=0..1),
    BendingStiffness=Slider(0, range=0..1),
    PreTension=1,
    Anchors=item,
    GroupIndex="1")
scene = FlexScene(Cloths=flatten(cloth))
panel_2 = Panel(scene)
flex = FlexEngine(
    FlexParams=parameters,
    FlexCollisionGeometry=collgeometry,
    FlexScene=flatten(scene),
    FlexSolverOptions=opts,
    LockMode=Toggle(False),
    Reset=reset,
    Go=go)  # -> FlexObject, Information
panel_3 = Panel(flex.Information)

# ----
# Enable me if you need me
# as I slow down simulation
toggle = BooleanToggle(False)
cloths = GetCloths(FlexObject=flex.FlexObject, N=1, DrawParticles=toggle, ClothObject=cloth)  # -> Points, Vector, Meshes

bake = InstantBake(Objects=flatten(cloths.Meshes), LayerName="Layer 02", MaterialName="Default material", ClearLayer=False)
allparts = GetAllParticles(FlexObject=flex.FlexObject, N=1)  # -> Points, Vector; disabled
vdis = VectorDisplay(Anchor=allparts.Points, Vector=expr("x*0.025", allparts.Vector))
