# Grasshopper definition SoftBunnyDemo.gh (Grasshopper 1.0.5)
# plug-ins: FlexHopper, Weaverbird

mesh = Mesh(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)

# ----
# Many bunnies
number_slider = Slider(10, range=1..100)
random = Random(Range=Domain(5, 60), Number=expr("x*3", number_slider), Seed=346)
random_2 = Random(Range=Domain(-1, 1), Number=expr("x*3", number_slider), Seed=3)
partition = PartitionList(List=random, Size=3)
partition_2 = PartitionList(List=random_2, Size=3)
item = ListItem(List=partition, Index=0, Wrap=True)  # -> Item, Item1, Item2
item_2 = ListItem(List=partition_2, Index=0, Wrap=True)  # -> Item, Item1, Item2
vec = VectorXYZ(XComponent=item_2.Item, YComponent=item_2.Item1, ZComponent=item_2.Item2)  # -> Vector, Length
pt = ConstructPoint(XCoordinate=item.Item, YCoordinate=item.Item1, ZCoordinate=item.Item2)
pl = PlaneNormal(Origin=pt, ZAxis=vec.Vector)
orient = Orient(Geometry=mesh, Source=PlaneXY(0, 0, 0), Target=pl)  # -> flatten(Geometry), Transform

wbtriangles = WeaverbirdsSplitTrianglesSubdivision(MeshCurves=mesh, Level=3)
wblaplace = WeaverbirdsLaplacianSmoothing(MeshCurves=wbtriangles, Level=1, SmoothNakedEdges=1, Thin=1)

# ----
# One bunny
vec_2 = VectorXYZ(XComponent=0, YComponent=0, ZComponent=15)  # -> Vector, Length
move = Move(Geometry=wblaplace, Motion=vec_2.Vector)  # -> Geometry, Transform

parameters = FlexParametersFromValues(
    Gravity=Vector(0, 0, -9.81),
    Radius=0.15,
    SolidRestDistance=0.075,
    FluidRestDistance=0.1,
    CollisionDistance=0.075,
    ParticleCollisionMargin=0.5,
    ShapeCollisionMargin=0.5,
    MaxSpeed=3.402823466e+38,
    MaxAcceleration=1000,
    DynamicFriction=Slider(0.05, range=0..1),
    StaticFriction=Slider(0.05, range=0..1),
    ParticleFriction=0,
    Restitution=0,
    Adhesion=0,
    SleepThreshold=0,
    ShockPropagation=0,
    Dissipation=0,
    Damping=Slider(0.2, range=0..1),
    Fluid=True,
    Viscosity=0,
    Cohesion=0.025,
    SurfaceTension=0,
    SolidPressure=1,
    FreeSurfaceDrag=0,
    Buoyancy=1,
    PlasticThreshold=0,
    PlasticCreep=0,
    Wind=Vector(0, 0, 0),
    Drag=0,
    Lift=0,
    RelaxationMode=True,
    RelaxationFactor=1)
filter = StreamFilter(Gate=Toggle(True), Stream0=move.Geometry, Stream1=orient.Geometry)
panel = Panel("""1
2
0
1.5
2
0.1
1.5
0.0
0.0""")
panel_2 = Panel("""0.6
2
0
0.7
1.2
0.2
1
0.0
0.0""")
soft = SoftFromMesh(SoftBodyMesh=flatten(filter), Velocities=Vector(0, 0, 0), Mass=1, SoftParams=panel, GroupIndex=0)  # -> Particles, SpringIndices, simplify(ShapeMatchingConstraintIndices), SpringLines, ShapeMatchingConstraintBoundingBox, SoftBodies
xy = XYPlane(Origin=Point(0, 0, 0))
collgeometry = FlexCollisionGeometry(CollisionPlanes=flatten(xy))
scene = FlexScene(SoftBodies=flatten(soft.SoftBodies))
opts = FlexSolverOptions(TimeStep=Slider(0.05, range=0..0.1), SubSteps=Slider(6, range=1..15), NumIterations=Slider(6, range=1..15))
panel_3 = Panel(scene)
flex = FlexEngine(
    FlexParams=parameters,
    FlexCollisionGeometry=collgeometry,
    FlexScene=flatten(scene),
    FlexSolverOptions=opts,
    LockMode=False,
    Reset=Button(),
    Go=Toggle(False))  # -> FlexObject, Information
softs = GetSoftBodies(FlexObject=flex.FlexObject, Softs=soft.SoftBodies)  # -> Points, Velocity, SpringLines, ShapeMatchingBoxes
material = CreateMaterial(
    Diffuse=ColourSwatch(SwatchColor=RGB(80, 98, 143)),
    Specular=ColourSwatch(SwatchColor=RGB(29, 31, 36)),
    Emission=ColourSwatch(SwatchColor=RGB(80, 98, 143)),
    Transparency=Slider(0.8, range=0..1),
    Shine=Slider(1, range=0..100))
preview = CustomPreview(Geometry=soft.ShapeMatchingConstraintBoundingBox, Material=material)
swatch = ColourSwatch(SwatchColor=RGB(0, 17, 255))
preview_2 = CustomPreview(Geometry=soft.SpringLines, Material=swatch)
preview_3 = CustomPreview(Geometry=softs.SpringLines, Material=swatch)  # disabled
preview_4 = CustomPreview(Geometry=softs.ShapeMatchingBoxes, Material=material)
