# Grasshopper definition simple_particles_collision.gh (Grasshopper 0.9.76)
# plug-ins: MeshEdit Components, FlexHopper

# ----
# Random Points
number_slider = Slider(100, range=0.001..200)
dom = ConstructDomain(DomainStart=expr("x*-1", number_slider), DomainEnd=number_slider)
random = Random(Range=dom, Number=expr("x*3", Slider(100, range=1..10000)), Seed=Slider(2, range=0..50))
partition = PartitionList(List=random, Size=3)
item = ListItem(List=partition, Index=0, Wrap=True)  # -> Item, Item1, Item2
addition = Addition(A=item.Item2, B=number_slider)
pt = ConstructPoint(XCoordinate=item.Item, YCoordinate=item.Item1, ZCoordinate=addition)  # -> flatten(Point)

xz = XZPlane(Origin=Point(0, 0, 0))
yz = YZPlane(Origin=Point(0, 0, 0))
rotate = Rotate(Geometry=xz, Angle=Slider(-1, range=-3.1415..3.1416), Plane=yz)  # -> Geometry, Transform
vec = VectorXYZ(XComponent=0, YComponent="100", ZComponent=0)  # -> Vector, Length
move = Move(Geometry=rotate.Geometry, Motion=vec.Vector)  # -> Geometry, Transform
rotate_2 = Rotate(Geometry=move.Geometry, Angle=[0, 1.570796327, 3.141592654, 4.71238898], Plane=PlaneXY(0, 0, 0))  # -> Geometry, Transform

xy = XYPlane(Origin=Point(0, 0, 0))  # disabled

number_slider_2 = Slider(55.217, range=0.001..200)
number_slider_3 = Slider(3, range=1..5)
dom_2 = ConstructDomain(DomainStart=expr("x*-1", number_slider_2), DomainEnd=number_slider_2)
range = Range(Domain=dom_2, Steps=expr("x-1", number_slider_3))
random_2 = Random(Range=Domain(0, 1), Number=expr("x*x*x*3", number_slider_3), Seed=2)
partition_2 = PartitionList(List=random_2, Size=3)
addition_2 = Addition(A=range, B=number_slider_2)
pt_2 = ConstructPoint(XCoordinate=range, YCoordinate=graft(range), ZCoordinate=0)
Z = UnitZ(Factor=addition_2)
item_2 = ListItem(List=partition_2, Index=0, Wrap=True)  # -> Item, Item1, Item2
move_2 = Move(Geometry=flatten(pt_2), Motion=graft(Z))  # -> flatten(Geometry), Transform
vec_2 = VectorXYZ(XComponent=item_2.Item, YComponent=item_2.Item1, ZComponent=item_2.Item2)  # -> flatten(Vector), Length
pl = PlaneNormal(Origin=move_2.Geometry, ZAxis=vec_2.Vector)

# ----
# Colliding Boxes
toggle = BooleanToggle(True)
number_slider_4 = Slider(6.9, range=0..50)
avr = Average(Input=pt)
filter = StreamFilter(Gate=toggle, Stream0=avr, Stream1=pl)
box = CenterBox(Base=filter, X=number_slider_4, Y=number_slider_4, Z=number_slider_4)

pln = Plane([rotate_2.Geometry, xy])
number_slider_5 = Slider(10, range=0.01..20)
number_slider_6 = Slider(8, range=0.01..10)
number_slider_7 = Slider(10, range=0..30)
number_slider_8 = Slider(4, range=0..10)
number_slider_9 = Slider(0, range=0..10)
particles = ParticlesFromPoints(Positions=pt, SelfCollision=Toggle(True))
parameters = FlexParametersFromValues(
    Gravity=Vector(0, 0, -9.81),
    Radius=number_slider_5,
    SolidRestDistance=number_slider_6,
    FluidRestDistance=0.1,
    CollisionDistance=number_slider_8,
    ParticleCollisionMargin=number_slider_7,
    ShapeCollisionMargin=number_slider_9,
    MaxSpeed=3.402823466e+38,
    MaxAcceleration=100,
    StaticFriction=Slider(10, range=0..10),
    ParticleFriction=0,
    Restitution=0,
    Adhesion=0,
    SleepThreshold=0,
    ShockPropagation=0,
    Dissipation=0,
    Damping=0,
    Fluid=True,
    Viscosity=0,
    Cohesion=0.025,
    SurfaceTension=0,
    SolidPressure=1,
    FreeSurfaceDrag=0,
    Buoyancy=1,
    PlasticThreshold=0,
    PlasticCreep=0,
    Wind=Vector(0, 0, 0),
    Drag=0,
    Lift=0,
    RelaxationMode=True,
    RelaxationFactor=1)
scene = FlexScene(Particles=flatten(particles))
opts = FlexSolverOptions(TimeStep=Slider(0.04, range=1e-05..0.2), SubSteps=3, NumIterations=3)
preview_spheres = BooleanToggle(False)

flip_faces = BooleanToggle(False)
vec_3 = VectorXYZ(
    XComponent=expr("x*0.7", number_slider),
    YComponent=expr("x*0.7", number_slider),
    ZComponent=expr("x*0.7", number_slider))  # -> Vector, Length
msphereex = MeshSphereEx(Base=PlaneXY(0, 0, 0), Radius=Slider(100, range=0..200), Count=5)
move_3 = Move(Geometry=msphereex, Motion=vec_3.Vector)  # -> Geometry, Transform

# ----
# Triangulate & Clean Up
tri = Triangulate(Mesh=move_3.Geometry)  # -> Mesh, Count
weldvertices = MeshWeldVertices(Mesh=tri.Mesh, Tolerance=0.6)  # -> RuntimeMessage, Mesh

# ----
# Flip Face Directions
demesh = DeconstructMesh(Mesh=weldvertices.Mesh)  # -> Vertices, Faces, Colours, Normals
deface = DeconstructFace(Face=demesh.Faces)  # -> CornerA, CornerB, CornerC, CornerD
triangle = MeshTriangle(CornerA=deface.CornerA, CornerB=deface.CornerC, CornerC=deface.CornerB)
conmesh = ConstructMesh(Vertices=demesh.Vertices, Faces=triangle)

filter_2 = StreamFilter(Gate=flip_faces, Stream0=weldvertices.Mesh, Stream1=conmesh)

facen = FaceNormals(Mesh=filter_2)  # -> Centers, Normals
preview = CustomPreview(Geometry=filter_2, Shader=ColourSwatch(SwatchColor=RGBA(0, 0, 0, 32)))
vdis = VectorDisplay(Anchor=facen.Centers, Vector=expr("x*10", facen.Normals))
collgeometry = FlexCollisionGeometry(CollisionPlanes=flatten(pln), CollisionBoxes=flatten(box), CollisionMeshes=flatten(filter_2))
flex = FlexEngine(
    FlexParams=parameters,
    FlexCollisionGeometry=collgeometry,
    FlexScene=flatten(scene),
    FlexSolverOptions=opts,
    LockMode=False,
    Reset=Button(),
    Go=Toggle(False))  # -> FlexObject, Information
gate = StreamGate(Stream=flex.FlexObject, Gate=preview_spheres)  # -> Target0, Target1
particles_2 = GetParticleDescription(FlexObject=flex.FlexObject, N=1)  # disabled

# ----
# Visualisation
allparts = GetAllParticles(FlexObject=gate.Target1, N=1)  # -> Points, Vector
detail = Slider(6, range=2..8)
msphereex_2 = MeshSphereEx(Base=allparts.Points, Radius=expr("x*0.5", number_slider_5), Count=detail)
msphereex_3 = MeshSphereEx(Base=allparts.Points, Radius=expr("x*0.5", number_slider_6), Count=detail)
msphereex_4 = MeshSphereEx(Base=allparts.Points, Radius=number_slider_7, Count=detail)
msphereex_5 = MeshSphereEx(Base=allparts.Points, Radius=number_slider_8, Count=detail)
msphereex_6 = MeshSphereEx(Base=allparts.Points, Radius=number_slider_9, Count=detail)
preview_2 = CustomPreview(Geometry=msphereex_2, Shader=ColourSwatch(SwatchColor=RGBA(0, 187, 255, 169)))
preview_3 = CustomPreview(Geometry=msphereex_3, Shader=ColourSwatch(SwatchColor=RGBA(255, 0, 0, 200)))
preview_4 = CustomPreview(Geometry=msphereex_4, Shader=ColourSwatch(SwatchColor=RGBA(255, 82, 82, 98)))
preview_5 = CustomPreview(Geometry=msphereex_5, Shader=ColourSwatch(SwatchColor=RGB(255, 251, 0)))
preview_6 = CustomPreview(Geometry=msphereex_6, Shader=ColourSwatch(SwatchColor=RGBA(255, 253, 122, 84)))

allparts_2 = GetAllParticles(FlexObject=gate.Target0, N=1)  # -> Points, Vector
cloud = CloudDisplay(Points=allparts_2.Points, Colours=ColourSwatch(SwatchColor=RGB(58, 164, 240)), Size=1, SpriteType=1)
