# Grasshopper definition z_spring_constraints.gh (Grasshopper 0.9.76)
# plug-ins: FlexHopper

numsprings = Slider(12, range=1..100)
series = Series(Start=0, Step=1, Count=expr("x+1", numsprings))

# ----
# Connect neighbors
# (controls elasticity)
shift = ShiftList(List=series, Shift=1, Wrap=False)
weave = Weave(Pattern=[0, 1], Stream0=series, Stream1=shift, NullGaps=False)
split = SplitList(List=reverse(weave), Index=1)  # -> ListA, reverse(ListB)
springs = SpringConstraints(SpringPairIndices=flatten(split.ListB), SpringStiffness=Slider(0.95, range=0..0.99))

# ----
# Connect next but one neighbors
# (controls bending / crumbling)
shift_2 = ShiftList(List=series, Shift=2, Wrap=False)
weave_2 = Weave(Pattern=[0, 1], Stream0=series, Stream1=shift_2, NullGaps=False)
springs_2 = SpringConstraints(SpringPairIndices=flatten(weave_2), SpringStiffness=Slider(0.99, range=0..0.99))

range = Range(Domain=Domain(0, 20), Steps=numsprings)
pt = ConstructPoint(XCoordinate=range, YCoordinate=0, ZCoordinate=50)
toggle = BooleanToggle(False)
particles = ParticlesFromPoints(Positions=pt, Masses=-1, SelfCollision=toggle, IsFluid=toggle)
anchor = Anchor(AnchorIndex="0")

# ----
# Play with this!
number_slider = Slider(30, range=1..30)

scene = FlexScene(Particles=flatten(particles), LocalConstraints=flatten([anchor, springs, springs_2]))
opts = FlexSoverOptions(TimeStep=0.025, SubSteps=3, NumIterations=number_slider)
flex = FlexEngine(FlexScene=flatten(scene), FlexSolverOptions=opts, LockMode=False, Reset=Button(), Go=Toggle(False))  # -> FlexObject, Information
allsprings = GetAllSprings(FlexObject=flex.FlexObject, N=1)
